# Grasshopper definition 2Canopies_Wind.gh (Grasshopper 1.0.8)
# plug-ins: Heteroptera, Pufferfish, eleFront

# https://climate.onebuilding.org/WMO_Region_2_Asia/ARE_United_Arab_Emirates/ARE_AZ_Abu.Dhabi.Intl.AP.412170_TMYx.zip
panel = Panel("https://energyplus-weather.s3.amazonaws.com/asia_wmo_region_2/ARE/ARE_Abu.Dhabi.412170_IWEC/ARE_Abu.Dhabi.412170_IWEC.zip")
reference_block_by_name = ReferenceBlockByName(BlockName="Tree", getNestedBlocks=False, lightweight=False)
downloadepw = LBDownloadWeather(weather_URL=panel)  # -> epw_file, stat_file, ddy_file; plug-in component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
explode_block = ExplodeBlock(Block=reference_block_by_name, recursive=False)  # -> Name, Transform, Geometry
curve = Curve(<curve referenced from the Rhino model>)
unit_z = UnitZ(Factor="1.5")
geometry_pipeline = GeometryPipeline(
    GroupByLayer=False,
    GroupByType=False,
    IncludeHidden=True,
    IncludeLocked=True,
    LayerFilter="Furniture",
    NameFilter="*",
    SublayerFiltering=True,
    TypeFilter=1073741848)
brep = Brep(curve)
panel_2 = Panel("30")
panel_3 = Panel("3")
importepw = LBImportEPW(epw_file=downloadepw.epw_file)  # -> location, dry_bulb_temperature, dew_point_temperature, relative_humidity, wind_speed, wind_direction, direct_normal_rad, diffuse_horizontal_rad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; plug-in component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
extrude = Extrude(Base=brep, Direction=unit_z)
area = Area(Geometry=brep)  # -> Area, Centroid
panel_4 = Panel("6")
brep_2 = Brep([<brep referenced from the Rhino model> x5])
brep_3 = Brep(geometry_pipeline)
brep_4 = Brep(explode_block.Geometry)
panel_5 = Panel("1")
entwine = Entwine(Branch00=brep_2, Branch01=brep_3, FlattenInputs=True)  # -> flatten(Result)
breppts = BrepPointPopulator(breps=extrude, spacing="2")  # -> out, a; inputs breps: tree of Brep, spacing: Double
# ---------- breppts: Python ----------
from ghpythonlib.componentbase import executingcomponent as component
import Rhino
import Rhino.Geometry as rg
import Grasshopper
from Grasshopper.Kernel.Data import GH_Path
from Grasshopper import DataTree
import System
import math

ghenv.Component.Name = "Brep Point Populator"
ghenv.Component.NickName = "BrepPts"

class CustomComponent(component):
    def RunScript(self,
            breps: Grasshopper.DataTree[Rhino.Geometry.Brep],
            spacing: float):

        out_points = DataTree[rg.Point3d]()

        if breps is None or breps.BranchCount == 0:
            return out_points

        if spacing is None or spacing <= 0:
            spacing = 1.0

        tol = Rhino.RhinoDoc.ActiveDoc.ModelAbsoluteTolerance
        z_tol = max(tol * 10, 0.01)

        # ── 1. Collect all breps with metadata ──
        brep_entries = []
        for i in range(breps.BranchCount):
            path = breps.Path(i)
            branch = breps.Branch(i)
            for j in range(branch.Count):
                b = branch[j]
                if b is not None:
                    bb = b.GetBoundingBox(True)
                    z_val = round(bb.Min.Z, 2)
                    brep_entries.append({
                        "brep": b,
                        "z": z_val,
                        "path": path,
                        "index": j
                    })

        if len(brep_entries) == 0:
            return out_points

        # ── 2. Group breps by Z level ──
        level_keys = []
        level_map = {}

        for entry in brep_entries:
            z = entry["z"]
            matched = None
            for key in level_keys:
                if abs(key - z) < z_tol:
                    matched = key
                    break
            if matched is not None:
                level_map[matched].append(entry)
            else:
                level_keys.append(z)
                level_map[z] = [entry]

        # ── 3. Per level: bounding box → grid → filter per brep ──
        for z_level in sorted(level_keys):
            entries = level_map[z_level]

            # Level bounding box (union of all breps at this Z)
            level_bb = rg.BoundingBox.Empty
            for entry in entries:
                level_bb.Union(entry["brep"].GetBoundingBox(True))

            x_min = level_bb.Min.X
            x_max = level_bb.Max.X
            y_min = level_bb.Min.Y
            y_max = level_bb.Max.Y
            z_mid = (level_bb.Min.Z + level_bb.Max.Z) / 2.0

            # Populate grid points
            nx = int(math.ceil((x_max - x_min) / spacing)) + 1
            ny = int(math.ceil((y_max - y_min) / spacing)) + 1

            grid_pts = []
            for ix in range(nx):
                x = x_min + ix * spacing
                for iy in range(ny):
                    y = y_min + iy * spacing
                    grid_pts.append(rg.Point3d(x, y, z_mid))

            # ── 4. Cull points outside each brep & build output tree ──
            for entry in entries:
                brep = entry["brep"]
                orig_path = entry["path"]
                idx = entry["index"]

                # Output path = {original path; item index}
                path_indices = [orig_path.Indices[k] for k in range(orig_path.Length)]
                path_indices.append(idx)
                out_path = GH_Path(System.Array[int](path_indices))

                inside = [pt for pt in grid_pts
                          if brep.IsPointInside(pt, tol, False)]
                out_points.AddRange(inside, out_path)

        return out_points
# ---------- end breppts ----------
panel_6 = Panel("(3,4)")
analysisperiod = LBAnalysisPeriod(start_month=1, start_day=1, start_hour=0)  # -> period, hoys, dates; plug-in component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
analysisperiod_2 = LBAnalysisPeriod(start_month="11", start_day="30", start_hour="13", end_month="11", end_day="30", end_hour="13")  # -> period, hoys, dates; plug-in component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
mesh = Mesh(entwine)
data = Data(breppts.a)
brep_5 = Brep(entwine)
applyper = LBApplyAnalysisPeriod(data=importepw.dry_bulb_temperature, period=analysisperiod.period)  # -> data; plug-in component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
applyper_2 = LBApplyAnalysisPeriod(data=importepw.relative_humidity, period=analysisperiod.period)  # -> data; plug-in component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
applyper_3 = LBApplyAnalysisPeriod(data=importepw.wind_speed, period=analysisperiod.period)  # -> data; plug-in component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
applyper_4 = LBApplyAnalysisPeriod(data=importepw.wind_direction, period=analysisperiod.period)  # -> data; plug-in component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
point = Point([<point referenced from the Rhino model> x920])
applyper_5 = LBApplyAnalysisPeriod(data=importepw.direct_normal_rad, period=analysisperiod.period)  # -> data; plug-in component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
applyper_6 = LBApplyAnalysisPeriod(data=importepw.diffuse_horizontal_rad, period=analysisperiod.period)  # -> data; plug-in component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
applyper_7 = LBApplyAnalysisPeriod(data=importepw.horizontal_infrared_rad, period=analysisperiod.period)  # -> data; plug-in component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
windrose = LBWindRose(data=applyper_3, wind_direction=applyper_4, center_pt=area.Centroid)  # -> report, mesh, compass, orient_line, freq_line, windrose_line, legend, title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; plug-in component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
Y = UnitY(Factor=1)
pt = Point(area.Centroid)
xdata = LBDeconstructData(data=importepw.wind_speed)  # -> header, values; plug-in component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
rotate = Rotate(Geometry=Y, Angle=expr("-x+180", degrees(windrose.prevailing)), Plane=PlaneXY(0, 0, 0))  # -> Geometry, Transform
extremes = MinMax(Number=xdata.values)  # -> Minimum, Maximum
unit = UnitVector(Vector=rotate.Geometry)
construct_domain = ConstructDomain(DomainStart=expr("x/2", "2"), DomainEnd=expr("-x/2", "2"))
line = LineSDL(Start=pt, Direction=unit, Length="100")
unit_z_2 = UnitZ(Factor=1)
unit_y = UnitY(Factor=1)
panel_7 = Panel(extremes.Maximum)
construct_point = ConstructPoint(XCoordinate=0, YCoordinate=0, ZCoordinate=0)
rotate_2 = Rotate(Vector=unit_y, Axis=unit_z_2, Angle=degrees("180"))
amplitude = Amplitude(Vector=rotate_2, Amplitude="2")
entwine_2 = Entwine(Branch00=brep_2, Branch01=brep_3, FlattenInputs=True)  # -> flatten(Result)
rectangle = Rectangle(Plane=point, XSize=construct_domain, YSize=construct_domain, Radius=0)  # -> Rectangle, Length
inoutrefmode = Butterfly_LocationRefinementMode(mode=0, level="3")  # -> location_ref_mode; plug-in component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
vector_display = VectorDisplay(Anchor=construct_point, Vector=amplitude)
mesh_brep = MeshBrep(
    Brep=rectangle.Rectangle,
    Settings={GridMaxCount=0, GridMinCount=16, JaggedSeams=False, MaxEdgeLength=0, MinEdgeLength=0.0001, MinTolerance=0, Refine=True, RefineAngle=0, RelativeTolerance=0.65, SimplePlanes=True, Tolerance=0})
brep_6 = Brep(rectangle.Rectangle)
tunnelparams = Butterfly_WindTunnelParameters(windward_x=5, top_x=5, sides_x=5, leeward_x=15)  # -> report, tunnel_params; plug-in component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
windvector = Butterfly_WindVector(wind_speed="10", wind_direction=rotate_2)  # -> wind_vector; plug-in component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
brep_7 = Brep(<brep referenced from the Rhino model>)
python_3_script = Python3Script(
    context=brep_5,
    refine=brep_7,
    probes=point,
    trees=brep_4,
    wind_dir="90",
    end_time="100",
    run=Toggle(True),
    u_ref="10",
    cell_size="5.0",
    refine_level="3",
    cores="8",
    refresh=Button())  # -> out, U, U_mag, report, is_running, case_dir; inputs context: list of Brep, refine: Brep, probes: list of Point3d, trees: list of Brep, surface_level: list, f: list
# ---------- python_3_script: Python ----------
# -*- coding: utf-8 -*-
"""
Pedestrian wind CFD study for OpenFOAM 5.x (blueCFD-Core 2017, Windows) without Butterfly.
Rhino 8 Grasshopper script component (CPython 3). Self-configuring inputs and outputs.
All geometry is expected in metres.

Workflow:
  1. Drop a Rhino 8 Script component, paste this script, close the editor.
     The component rebuilds its own inputs and outputs (INPUT_SPEC / OUTPUT_SPEC).
  2. Connect inputs, set run_ = True (Button or Toggle). The run starts in the background.
  3. Press refresh_ (Button) to re-read logs and probe results while it runs.
"""

import os
import re
import json
import math
import glob
import time
import shutil
import hashlib
import traceback
import subprocess

import System
import Rhino
import Rhino.Geometry as rg
import scriptcontext as sc
from Grasshopper.Kernel import GH_ParamAccess, GH_RuntimeMessageLevel, GH_Document


# =============================================================================
# PARAMETER SPECIFICATION
# =============================================================================
INPUT_SPEC = [
    # (name, access, description, optional)
    ("context_", "list", "All solid context geometry in metres (buildings, podium, parapets, canopies, pool walls). Meshed as solid walls.", False),
    ("refine_", "item", "Refinement volume (Brep/Box). Its bounding box in rotated wind coordinates becomes a searchableBox refinement region.", False),
    ("probes_", "list", "Pedestrian-level probe points (Point3d), typically 1.5 m above the walking surface.", False),
    ("trees_", "list", "Tree canopies only (Brep/Box). Each item becomes its own porous cellZone. Never meshed as a solid.", True),
    ("wind_dir_", "item", "Direction the wind blows FROM in degrees, meteorological convention (0 = N, 90 = E).", False),
    ("end_time_", "item", "Solver iterations. Default 100. Use 1000 to 2000 for report results.", True),
    ("run_", "item", "Start the run in the background. Default False.", True),
    ("u_ref_", "item", "ABL reference velocity at z_ref_ in m/s. Default 5.0.", True),
    ("z_ref_", "item", "ABL reference height in m. Default 10.0.", True),
    ("z0_", "item", "Aerodynamic roughness length in m. Default 0.5.", True),
    ("cell_size_", "item", "Background blockMesh cell size in m. Default 5.0.", True),
    ("refine_level_", "item", "Refinement level inside refine_. Default 3 (5.0 / 2^3 = 0.625 m).", True),
    ("surface_level_", "list", "Context surface refinement levels (min, max). Default (3, 4).", True),
    ("f_", "list", "Forchheimer coefficient f = 2 x Cd x LAD (1/m). One value for all trees or one value per tree. Default 0.5.", True),
    ("trunk_h_", "item", "Clear trunk height in m removed from the bottom of each tree before export. Default 2.5. Use 0 if trees_ are canopy-only.", True),
    ("cores_", "item", "Number of MPI processes. Default 8.", True),
    ("case_root_", "item", "Case root folder. Default C:/Users/<user>/butterfly.", True),
    ("bluecfd_", "item", "Path to blueCFD setvars.bat. Auto-detected under C:/Program Files/blueCFD-Core-2017 if empty.", True),
    ("reuse_mesh_", "item", "Reuse a valid existing mesh for this direction (only rewrite tree zones and rerun the solver). Default True.", True),
    ("refresh_", "item", "Re-read logs and probe results while the run is in the background (connect a Button).", True),
]

OUTPUT_SPEC = [
    # (name, access, description)
    ("U", "list", "Velocity vector per probe in WORLD coordinates. None for skipped probes."),
    ("U_mag", "list", "Velocity magnitude per probe in m/s. None for skipped probes."),
    ("report", "item", "Stage, mesh check summary, tree zone cell counts, final residuals and warnings."),
    ("is_running", "item", "True while the OpenFOAM run is active."),
    ("case_dir", "item", "OpenFOAM case directory."),
]

_ACCESS = {"item": GH_ParamAccess.item, "list": GH_ParamAccess.list, "tree": GH_ParamAccess.tree}
_NO_WINDOW = 0x08000000


# =============================================================================
# SELF CONFIGURATION (Rhino 8 ScriptVariableParam)
# =============================================================================
_SVP_TYPE = None


def _find_svp_type():
    """Locate RhinoCodePluginGH.Parameters.ScriptVariableParam (Rhino 8 script parameter)."""
    global _SVP_TYPE
    if _SVP_TYPE is not None:
        return _SVP_TYPE
    try:
        from RhinoCodePluginGH.Parameters import ScriptVariableParam
        _SVP_TYPE = ScriptVariableParam
        return _SVP_TYPE
    except Exception:
        pass
    try:
        for asm in System.AppDomain.CurrentDomain.GetAssemblies():
            try:
                t = asm.GetType("RhinoCodePluginGH.Parameters.ScriptVariableParam")
            except Exception:
                t = None
            if t is not None:
                _SVP_TYPE = t
                return t
    except Exception:
        pass
    return None


def _is_svp(p):
    try:
        return p.GetType().Name == "ScriptVariableParam"
    except Exception:
        return False


def _create_svp(name, template_type):
    """Create a ScriptVariableParam. Never falls back to Param_GenericObject (that causes the cast error)."""
    candidates = []
    t = _find_svp_type()
    if t is not None:
        candidates.append(t)
    if template_type is not None:
        candidates.append(template_type)
    for T in candidates:
        if isinstance(T, System.Type):
            for args in ([name], []):
                try:
                    if args:
                        arr = System.Array[System.Object](args)
                        p = System.Activator.CreateInstance(T, arr)
                    else:
                        p = System.Activator.CreateInstance(T)
                    if p is not None:
                        return p
                except Exception:
                    pass
        else:
            for args in ((name,), ()):
                try:
                    p = T(*args)
                    if p is not None:
                        return p
                except Exception:
                    pass
    return None


def _new_param(name, desc, access, optional, template_type):
    p = _create_svp(name, template_type)
    if p is None:
        raise RuntimeError("Could not create a ScriptVariableParam for '%s'." % name)
    for attr, val in (("Name", name), ("NickName", name), ("Description", desc),
                      ("VariableName", name), ("PrettyName", name)):
        try:
            setattr(p, attr, val)
        except Exception:
            pass
    try:
        p.Access = access
    except Exception:
        pass
    try:
        p.Optional = optional
    except Exception:
        pass
    try:
        p.CreateAttributes()
    except Exception:
        pass
    return p


def _params_match():
    prm = ghenv.Component.Params
    cur_in = list(prm.Input)
    if len(cur_in) != len(INPUT_SPEC):
        return False
    for p, spec in zip(cur_in, INPUT_SPEC):
        n, a = spec[0], spec[1]
        if p.NickName != n and p.Name != n:
            return False
        if p.Access != _ACCESS[a] or not _is_svp(p):
            return False
    cur_out = [p for p in prm.Output if p.NickName != "out" and p.Name != "out"]
    if len(cur_out) != len(OUTPUT_SPEC):
        return False
    for p, spec in zip(cur_out, OUTPUT_SPEC):
        n = spec[0]
        if (p.NickName != n and p.Name != n) or not _is_svp(p):
            return False
    return True


def _configure():
    """Return True if parameters are being rebuilt (skip this solution)."""
    comp = ghenv.Component
    guid = str(comp.InstanceGuid)
    tries_key = "ofw_cfg_tries|" + guid
    if _params_match():
        sc.sticky[tries_key] = 0
        return False

    tries = sc.sticky.get(tries_key, 0)
    if tries >= 3:
        comp.AddRuntimeMessage(GH_RuntimeMessageLevel.Error,
                               "Automatic parameter setup failed 3 times. Delete the component and paste the script into a new Rhino 8 Script component.")
        return True
    sc.sticky[tries_key] = tries + 1

    template_type = None
    for p in list(comp.Params.Input) + list(comp.Params.Output):
        if _is_svp(p):
            template_type = p.GetType()
            break

    doc = comp.OnPingDocument()
    if doc is None:
        return True

    def _rebuild(gh_doc):
        prm = comp.Params
        try:
            for p in list(prm.Input):
                prm.UnregisterInputParameter(p, True)
            for p in list(prm.Output):
                if p.NickName != "out" and p.Name != "out":
                    prm.UnregisterOutputParameter(p, True)
            for n, a, d, o in INPUT_SPEC:
                prm.RegisterInputParam(_new_param(n, d, _ACCESS[a], o, template_type))
            for n, a, d in OUTPUT_SPEC:
                prm.RegisterOutputParam(_new_param(n, d, _ACCESS[a], True, template_type))
            try:
                comp.VariableParameterMaintenance()
            except Exception:
                pass
            prm.OnParametersChanged()
            comp.ExpireSolution(False)
        except Exception as e:
            comp.AddRuntimeMessage(GH_RuntimeMessageLevel.Error, "Parameter setup failed: %s" % e)

    dlg = GH_Document.GH_ScheduleDelegate(_rebuild)
    sc.sticky["ofw_cfg_dlg|" + guid] = dlg
    doc.ScheduleSolution(5, dlg)
    return True


# =============================================================================
# GENERIC HELPERS
# =============================================================================
def _g(name, default=None):
    v = globals().get(name, None)
    return default if v is None else v


def _flatten(v, out):
    """Flatten nested lists / tuples / .NET lists into out (strings and geometry are never iterated)."""
    if v is None:
        return
    if isinstance(v, (str, bytes)):
        out.append(v)
        return
    if isinstance(v, (list, tuple)):
        for x in v:
            _flatten(x, out)
        return
    try:
        if isinstance(v, System.Collections.IList):
            for x in v:
                _flatten(x, out)
            return
    except Exception:
        pass
    out.append(v)


def _as_list(v):
    out = []
    _flatten(v, out)
    return [x for x in out if x is not None]


def _to_float(v, d):
    try:
        if v is None or (isinstance(v, str) and not v.strip()):
            return d
        return float(v)
    except Exception:
        return d


def _to_int(v, d):
    try:
        if v is None or (isinstance(v, str) and not v.strip()):
            return d
        return int(round(float(v)))
    except Exception:
        return d


def _to_bool(v, d):
    if v is None:
        return d
    if isinstance(v, str):
        return v.strip().lower() in ("1", "true", "yes", "y", "on")
    try:
        return bool(v)
    except Exception:
        return d


def _is_num(s):
    try:
        float(s)
        return True
    except Exception:
        return False


def _c(x):
    return "%.4f" % x


def _n(x):
    return "%.6g" % x


def _doc_tol():
    try:
        return Rhino.RhinoDoc.ActiveDoc.ModelAbsoluteTolerance
    except Exception:
        return 0.001


def _read(path):
    try:
        with open(path, "r", errors="ignore") as f:
            return f.read()
    except Exception:
        return None


def _tail(path, n=12):
    t = _read(path)
    if not t:
        return "    (log empty or missing: %s)" % path
    lines = [l.rstrip() for l in t.splitlines() if l.strip()]
    return "\n".join("    " + l for l in lines[-n:])


def _write(path, text, crlf=False):
    d = os.path.dirname(path)
    if d:
        os.makedirs(d, exist_ok=True)
    with open(path, "w", newline=("\r\n" if crlf else "\n")) as f:
        f.write(text)


def _rm(path):
    try:
        if os.path.isdir(path):
            shutil.rmtree(path, ignore_errors=True)
        elif os.path.isfile(path):
            os.remove(path)
    except Exception:
        pass


def _hash(obj):
    return hashlib.md5(json.dumps(obj, sort_keys=True, default=str).encode("utf-8")).hexdigest()


def _win(path):
    return path.replace("/", "\\")


# =============================================================================
# GEOMETRY HELPERS
# =============================================================================
def _unwrap(o):
    """Unwrap Grasshopper goo, Rhino 8 script values and Rhino object references to raw RhinoCommon objects."""
    for _ in range(5):
        if o is None:
            return None
        if isinstance(o, (rg.GeometryBase, rg.Point3d, rg.Point3f, rg.Box, rg.BoundingBox)):
            return o
        try:
            if isinstance(o, System.Guid):
                ro = Rhino.RhinoDoc.ActiveDoc.Objects.FindId(o)
                return ro.Geometry if ro is not None else None
        except Exception:
            pass
        try:
            if isinstance(o, Rhino.DocObjects.RhinoObject):
                return o.Geometry
        except Exception:
            pass
        nxt = None
        for attr in ("ScriptVariable", "Value", "Geometry"):
            try:
                v = getattr(o, attr, None)
                if v is None:
                    continue
                if callable(v):
                    v = v()
                if v is not None and v is not o:
                    nxt = v
                    break
            except Exception:
                continue
        if nxt is None:
            return o
        o = nxt
    return o


def _type_name(o):
    try:
        return o.GetType().FullName
    except Exception:
        return type(o).__name__


def _coerce_geo(o):
    """Return a Brep or Mesh for any reasonable geometry input, otherwise None."""
    o = _unwrap(o)
    if o is None:
        return None
    try:
        if isinstance(o, rg.Brep):
            return o
        if isinstance(o, rg.Mesh):
            return o if o.Faces.Count > 0 else None
        if isinstance(o, rg.Extrusion):
            return o.ToBrep(True)
        if isinstance(o, rg.Box):
            return o.ToBrep() if o.IsValid else None
        if isinstance(o, rg.BoundingBox):
            return rg.Box(o).ToBrep() if o.IsValid else None
        if isinstance(o, rg.SubD):
            return rg.Mesh.CreateFromSubD(o, 2)
        if isinstance(o, rg.Surface):
            return rg.Brep.CreateFromSurface(o)
        if isinstance(o, rg.GeometryBase):
            b = rg.Brep.TryConvertBrep(o)
            if b is not None:
                return b
    except Exception:
        pass
    # Last resort: Grasshopper conversion (anything GH can cast to a Brep or Mesh)
    try:
        from Grasshopper.Kernel import GH_Convert
        ok, b = GH_Convert.ToBrep(o, rg.Brep(), 0)
        if ok and b is not None:
            return b
    except Exception:
        pass
    try:
        from Grasshopper.Kernel import GH_Convert
        ok, m = GH_Convert.ToMesh(o, rg.Mesh(), 0)
        if ok and m is not None and m.Faces.Count > 0:
            return m
    except Exception:
        pass
    return None


def _coerce_pt(o):
    o = _unwrap(o)
    if o is None:
        return None
    try:
        if isinstance(o, rg.Point3d):
            return o
        if isinstance(o, rg.Point):
            return o.Location
        if isinstance(o, rg.Point3f):
            return rg.Point3d(o.X, o.Y, o.Z)
    except Exception:
        pass
    try:
        from Grasshopper.Kernel import GH_Convert
        ok, p = GH_Convert.ToPoint3d(o, rg.Point3d.Unset, 0)
        if ok and p.IsValid:
            return p
    except Exception:
        pass
    return None


def _ext_of(geos):
    """Axis-aligned extents [minx, miny, minz], [maxx, maxy, maxz] of a geometry list."""
    mn = [1e30, 1e30, 1e30]
    mx = [-1e30, -1e30, -1e30]
    for g in geos:
        b = g.GetBoundingBox(True)
        if not b.IsValid:
            continue
        mn = [min(mn[0], b.Min.X), min(mn[1], b.Min.Y), min(mn[2], b.Min.Z)]
        mx = [max(mx[0], b.Max.X), max(mx[1], b.Max.Y), max(mx[2], b.Max.Z)]
    return mn, mx


def _fp_geo(objs):
    out = []
    for g in objs:
        try:
            b = g.GetBoundingBox(True)
            item = [round(v, 3) for v in (b.Min.X, b.Min.Y, b.Min.Z, b.Max.X, b.Max.Y, b.Max.Z)]
            if isinstance(g, rg.Brep):
                sx = sy = sz = 0.0
                for v in g.Vertices:
                    p = v.Location
                    sx += p.X
                    sy += p.Y
                    sz += p.Z
                item += [g.Vertices.Count, g.Faces.Count, round(sx, 3), round(sy, 3), round(sz, 3)]
            elif isinstance(g, rg.Mesh):
                item += [g.Vertices.Count, g.Faces.Count]
            out.append(item)
        except Exception:
            out.append(str(g))
    return out


def _dup(g):
    if isinstance(g, rg.Brep):
        return g.DuplicateBrep()
    if isinstance(g, rg.Mesh):
        return g.DuplicateMesh()
    return None


def _clean_mesh(m):
    m = m.DuplicateMesh()
    try:
        m.Vertices.CombineIdentical(True, True)
    except Exception:
        pass
    m.Faces.ConvertQuadsToTriangles()
    m.FaceNormals.ComputeFaceNormals()
    m.Normals.ComputeNormals()
    m.Compact()
    return m


def _mesh_geo(g):
    if g is None:
        return None
    if isinstance(g, rg.Mesh):
        return _clean_mesh(g)
    mp = rg.MeshingParameters.Default
    try:
        mp.JaggedSeams = False
        mp.SimplePlanes = True
    except Exception:
        pass
    parts = rg.Mesh.CreateFromBrep(g, mp)
    if not parts:
        return None
    m = rg.Mesh()
    for p in parts:
        m.Append(p)
    return _clean_mesh(m)


def _write_stl(path, solid, mesh):
    pts = mesh.Vertices.ToPoint3dArray()
    out = ["solid %s" % solid]
    n = 0
    for f in mesh.Faces:
        tris = [(f.A, f.B, f.C)] if f.IsTriangle else [(f.A, f.B, f.C), (f.A, f.C, f.D)]
        for a, b, c in tris:
            pa, pb, pc = pts[a], pts[b], pts[c]
            ux, uy, uz = pb.X - pa.X, pb.Y - pa.Y, pb.Z - pa.Z
            vx, vy, vz = pc.X - pa.X, pc.Y - pa.Y, pc.Z - pa.Z
            nx, ny, nz = uy * vz - uz * vy, uz * vx - ux * vz, ux * vy - uy * vx
            ln = math.sqrt(nx * nx + ny * ny + nz * nz)
            if ln < 1e-14:
                continue
            out.append("  facet normal %.6e %.6e %.6e" % (nx / ln, ny / ln, nz / ln))
            out.append("    outer loop")
            for p in (pa, pb, pc):
                out.append("      vertex %.6f %.6f %.6f" % (p.X, p.Y, p.Z))
            out.append("    endloop")
            out.append("  endfacet")
            n += 1
    out.append("endsolid %s" % solid)
    _write(path, "\n".join(out) + "\n")
    return n


def _trim_tree(g, trunk_h, tol):
    """Remove the clear trunk zone (trunk_h above the tree bottom). Returns (geometry, note)."""
    b = g.GetBoundingBox(True)
    if trunk_h <= 0:
        return g, ""
    zc = b.Min.Z + trunk_h
    if zc >= b.Max.Z - 0.05:
        return None, "trunk_h_ (%.2f m) is taller than the tree (%.2f m), tree skipped" % (trunk_h, b.Max.Z - b.Min.Z)
    if isinstance(g, rg.Brep) and g.IsSolid:
        cut_bb = rg.BoundingBox(rg.Point3d(b.Min.X - 1.0, b.Min.Y - 1.0, zc),
                                rg.Point3d(b.Max.X + 1.0, b.Max.Y + 1.0, b.Max.Z + 1.0))
        cutter = rg.Box(cut_bb).ToBrep()
        try:
            res = rg.Brep.CreateBooleanIntersection(g, cutter, tol)
        except Exception:
            res = None
        if res:
            best, bv = None, -1.0
            for r in res:
                try:
                    v = abs(r.GetVolume())
                except Exception:
                    v = 0.0
                if v > bv:
                    best, bv = r, v
            if best is not None and best.IsSolid:
                return best, ""
    box = rg.Box(rg.BoundingBox(rg.Point3d(b.Min.X, b.Min.Y, zc), b.Max)).ToBrep()
    return box, "trimmed to its bounding box (boolean trim failed or geometry is not a closed Brep)"


# =============================================================================
# INPUTS
# =============================================================================
def _read_inputs():
    P = {}
    P["context"] = _as_list(_g("context_"))
    P["refine"] = _g("refine_")
    if isinstance(P["refine"], (list, tuple)):
        rl = _as_list(P["refine"])
        P["refine"] = rl[0] if rl else None
    P["probes"] = _as_list(_g("probes_"))
    P["trees"] = _as_list(_g("trees_"))
    wd = _g("wind_dir_")
    P["wind_dir"] = None if wd is None else (_to_float(wd, 0.0) % 360.0)
    P["end_time"] = max(1, _to_int(_g("end_time_"), 100))
    P["run"] = _to_bool(_g("run_"), False)
    P["u_ref"] = max(0.1, _to_float(_g("u_ref_"), 5.0))
    P["z_ref"] = max(0.5, _to_float(_g("z_ref_"), 10.0))
    P["z0"] = max(1e-4, _to_float(_g("z0_"), 0.5))
    P["cell"] = max(0.1, _to_float(_g("cell_size_"), 5.0))
    P["rlev"] = min(8, max(0, _to_int(_g("refine_level_"), 3)))
    sl = [int(round(float(x))) for x in _as_list(_g("surface_level_")) if _is_num(x)]
    if len(sl) >= 2:
        s0, s1 = min(sl[0], sl[1]), max(sl[0], sl[1])
    elif len(sl) == 1:
        s0, s1 = sl[0], sl[0]
    else:
        s0, s1 = 3, 4
    P["slev"] = (min(8, max(0, s0)), min(8, max(0, s1)))
    fl = [max(0.0, float(x)) for x in _as_list(_g("f_")) if _is_num(x)]
    P["f"] = fl if fl else [0.5]
    P["trunk_h"] = max(0.0, _to_float(_g("trunk_h_"), 2.5))
    P["cores"] = max(1, _to_int(_g("cores_"), 8))
    root = _g("case_root_")
    root = str(root).strip().strip('"') if root else ""
    if not root:
        root = os.path.join(os.path.expanduser("~"), "butterfly")
    P["case_root"] = root.replace("\\", "/").rstrip("/")
    bc = _g("bluecfd_")
    P["bluecfd"] = str(bc).strip().strip('"') if bc else ""
    P["reuse"] = _to_bool(_g("reuse_mesh_"), True)
    P["refresh"] = _to_bool(_g("refresh_"), False)
    return P


def _case_name(d):
    if abs(d - round(d)) < 1e-6:
        tag = "%d" % (int(round(d)) % 360)
    else:
        tag = ("%.1f" % d).replace(".", "p")
    return "Wind_%sdeg" % tag


def _find_setvars(user):
    if user:
        u = user.replace("\\", "/")
        if os.path.isfile(u):
            return u
        if os.path.isdir(u):
            for c in ("setvars.bat", "setvars_OF5.bat"):
                if os.path.isfile(os.path.join(u, c)):
                    return os.path.join(u, c).replace("\\", "/")
        return None
    roots = ["C:/Program Files/blueCFD-Core-2017", "C:/Program Files (x86)/blueCFD-Core-2017", "C:/blueCFD-Core-2017"]
    for r in roots:
        if not os.path.isdir(r):
            continue
        for c in ("setvars.bat", "setvars_OF5.bat"):
            if os.path.isfile(r + "/" + c):
                return r + "/" + c
        hits = sorted(glob.glob(r + "/*/setvars*.bat")) + sorted(glob.glob(r + "/*/*/setvars*.bat"))
        if hits:
            return hits[0].replace("\\", "/")
    return None


# =============================================================================
# GEOMETRY PREPARATION (rotation, domain, probes, trees)
# =============================================================================
def _build_geometry(P, warns):
    tol = _doc_tol()

    ctx_world = []
    for i, o in enumerate(P["context"]):
        g = _coerce_geo(o)
        if g is None:
            warns.append("context_ item %d (type %s) is not a Brep or Mesh and was ignored." % (i, _type_name(o)))
            continue
        ctx_world.append(g)
    if not ctx_world:
        kinds = sorted(set(_type_name(o) for o in P["context"]))
        raise ValueError("context_ contains no valid Brep or Mesh geometry. Received %d item(s) of type: %s. "
                         "Use closed Breps, Extrusions, Boxes or Meshes and keep the input on List access."
                         % (len(P["context"]), ", ".join(kinds) or "none"))

    wmn, wmx = _ext_of(ctx_world)
    cx, cy, gz = 0.5 * (wmn[0] + wmx[0]), 0.5 * (wmn[1] + wmx[1]), wmn[2]

    # Wind FROM theta blows TOWARDS (-sin, -cos). Rotate so that this vector becomes +X.
    theta = math.radians(P["wind_dir"])
    fx, fy = -math.sin(theta), -math.cos(theta)
    alpha = -math.atan2(fy, fx)
    ca, sa = math.cos(alpha), math.sin(alpha)

    rot = rg.Transform.Rotation(alpha, rg.Vector3d(0, 0, 1), rg.Point3d(cx, cy, gz))
    mov = rg.Transform.Translation(rg.Vector3d(-cx, -cy, -gz))
    xf = mov * rot  # rotate first, then move site centre / ground to the origin

    def to_rot(x, y, z):
        dx, dy = x - cx, y - cy
        return (ca * dx - sa * dy, sa * dx + ca * dy, z - gz)

    ctx_rot = []
    for g in ctx_world:
        d = _dup(g)
        d.Transform(xf)
        ctx_rot.append(d)
    cmn, cmx = _ext_of(ctx_rot)
    H = max(cmx[2], 1.0)

    # Refinement box
    rgeo = _coerce_geo(P["refine"])
    if rgeo is None:
        raise ValueError("refine_ is not a valid Brep/Box (received %s)." % _type_name(P["refine"]))
    rr = _dup(rgeo)
    rr.Transform(xf)
    rmn, rmx = _ext_of([rr])

    # Trees
    f_list = P["f"]
    n_trees_in = len(P["trees"])
    if len(f_list) not in (1, n_trees_in) and n_trees_in > 0:
        warns.append("f_ has %d values but trees_ has %d items. Using f = %.3g for all trees." % (len(f_list), n_trees_in, f_list[0]))
        f_list = [f_list[0]]
    trees = []
    for i, o in enumerate(P["trees"]):
        g = _coerce_geo(o)
        if g is None:
            warns.append("trees_ item %d (type %s) is not a Brep/Box/Mesh and was ignored." % (i, _type_name(o)))
            continue
        t, note = _trim_tree(g, P["trunk_h"], tol)
        if t is None:
            warns.append("tree_%03d: %s." % (i, note))
            continue
        if note:
            warns.append("tree_%03d: %s." % (i, note))
        if isinstance(t, rg.Brep):
            try:
                if t.SolidOrientation == rg.BrepSolidOrientation.Inward:
                    t.Flip()
            except Exception:
                pass
        m = _mesh_geo(t)
        if m is None or not m.IsClosed:
            tb = t.GetBoundingBox(True)
            m = _mesh_geo(rg.Box(tb).ToBrep())
            warns.append("tree_%03d: mesh was not closed, exported as its bounding box." % i)
        m.Transform(xf)
        tmn, tmx = _ext_of([m])
        fi = f_list[i] if len(f_list) == n_trees_in and n_trees_in > 1 else f_list[0]
        inside_ref = all(tmn[k] >= rmn[k] - 1e-6 for k in range(3)) and all(tmx[k] <= rmx[k] + 1e-6 for k in range(3))
        if not inside_ref:
            warns.append("tree_%03d is not fully inside refine_. Its porous zone will use coarser cells." % i)
        trees.append({"index": i, "name": "tree_%03d" % i, "mesh": m, "f": fi,
                      "min": tmn, "max": tmx, "cut_z_world": round(g.GetBoundingBox(True).Min.Z + P["trunk_h"], 3)})

    # Probes
    ctx_bb = [(g, g.GetBoundingBox(True)) for g in ctx_world]
    pmap, skipped = [], {}
    for i, o in enumerate(P["probes"]):
        p = _coerce_pt(o)
        if p is None:
            skipped[i] = "not a point (type %s)" % _type_name(o)
            continue
        if p.Z < gz - 1e-6:
            skipped[i] = "below ground level"
            continue
        inside = False
        for g, b in ctx_bb:
            if not b.Contains(p):
                continue
            try:
                if isinstance(g, rg.Brep) and g.IsSolid and g.IsPointInside(p, tol, False):
                    inside = True
                elif isinstance(g, rg.Mesh) and g.IsClosed and g.IsPointInside(p, tol, False):
                    inside = True
            except Exception:
                pass
            if inside:
                break
        if inside:
            skipped[i] = "inside solid context"
            continue
        q = to_rot(p.X, p.Y, p.Z)
        pmap.append([i, q[0], q[1], q[2]])

    # Domain: 5H upstream, 15H downstream, 5H each side, 6H high, ground at 0
    cs = P["cell"]
    xmin, xmax = cmn[0] - 5.0 * H, cmx[0] + 15.0 * H
    ymin, ymax = cmn[1] - 5.0 * H, cmx[1] + 5.0 * H
    zmax = 6.0 * H
    others_mn = [rmn[:]]
    others_mx = [rmx[:]]
    for t in trees:
        others_mn.append(t["min"])
        others_mx.append(t["max"])
    for e in pmap:
        others_mn.append([e[1], e[2], e[3]])
        others_mx.append([e[1], e[2], e[3]])
    m2 = 2.0 * cs
    grew = False
    for a, b in zip(others_mn, others_mx):
        if a[0] - m2 < xmin or b[0] + m2 > xmax or a[1] - m2 < ymin or b[1] + m2 > ymax or b[2] + m2 > zmax:
            grew = True
        xmin, xmax = min(xmin, a[0] - m2), max(xmax, b[0] + m2)
        ymin, ymax = min(ymin, a[1] - m2), max(ymax, b[1] + m2)
        zmax = max(zmax, b[2] + m2)
    if grew:
        warns.append("Domain was enlarged to contain refine_, trees_ or probes_.")
    nx = int(math.ceil((xmax - xmin) / cs))
    ny = int(math.ceil((ymax - ymin) / cs))
    nz = int(math.ceil(zmax / cs))
    xmax, ymax, zmax = xmin + nx * cs, ymin + ny * cs, nz * cs
    if nx * ny * nz > 4e6:
        warns.append("Background mesh has %d cells. Consider a larger cell_size_." % (nx * ny * nz))

    # Refinement box clipped to the domain
    e = 0.01 * cs
    rbox_min = [max(rmn[0], xmin + e), max(rmn[1], ymin + e), max(rmn[2], -e)]
    rbox_max = [min(rmx[0], xmax - e), min(rmx[1], ymax - e), min(rmx[2], zmax - e)]
    if any(rbox_max[k] <= rbox_min[k] for k in range(3)):
        raise ValueError("refine_ does not overlap the computational domain.")

    # Point in open air: upstream, outside context and all trees
    def _inside_any(pt):
        for t in trees:
            if all(t["min"][k] - 0.5 <= pt[k] <= t["max"][k] + 0.5 for k in range(3)):
                return True
        if all(cmn[k] - 0.5 <= pt[k] <= cmx[k] + 0.5 for k in range(3)):
            return True
        return False

    loc = None
    zc = min(0.5 * zmax, max(1.2 * H, 2.0 * cs)) + 0.0171 * cs
    for fxr in (0.5, 0.3, 0.7, 0.15):
        for yo in (0.0, 0.25, -0.25, 0.4, -0.4):
            cand = (xmin + fxr * (cmn[0] - xmin) + 0.0137 * cs,
                    0.5 * (ymin + ymax) + yo * (ymax - ymin) + 0.0213 * cs,
                    zc)
            if not _inside_any(cand):
                loc = cand
                break
        if loc:
            break
    if loc is None:
        raise ValueError("Could not find an open-air point outside all trees and context for locationInMesh.")

    return {
        "alpha": alpha, "centre": [cx, cy, gz], "H": H,
        "ctx_rot": ctx_rot, "ctx_fp": _fp_geo(ctx_world), "trees": trees, "pmap": pmap, "skipped": skipped,
        "n_probes": len(P["probes"]),
        "domain": {"min": [xmin, ymin, 0.0], "max": [xmax, ymax, zmax], "n": [nx, ny, nz]},
        "rbox": {"min": rbox_min, "max": rbox_max}, "loc": list(loc),
    }


# =============================================================================
# OPENFOAM DICTIONARIES
# =============================================================================
def _hdr(cls, loc, obj):
    return ("/*--------------------------------*- C++ -*----------------------------------*\\\n"
            "  Written by the GhPython OpenFOAM pedestrian wind component (OpenFOAM 5.x)\n"
            "\\*---------------------------------------------------------------------------*/\n"
            "FoamFile\n{\n    version     2.0;\n    format      ascii;\n    class       %s;\n"
            "    location    \"%s\";\n    object      %s;\n}\n\n" % (cls, loc, obj))


def _d_blockmesh(G):
    d = G["domain"]
    x0, y0, z0 = d["min"]
    x1, y1, z1 = d["max"]
    nx, ny, nz = d["n"]
    v = [(x0, y0, z0), (x1, y0, z0), (x1, y1, z0), (x0, y1, z0),
         (x0, y0, z1), (x1, y0, z1), (x1, y1, z1), (x0, y1, z1)]
    s = _hdr("dictionary", "system", "blockMeshDict")
    s += "convertToMeters 1;\n\nvertices\n(\n"
    for p in v:
        s += "    (%s %s %s)\n" % (_c(p[0]), _c(p[1]), _c(p[2]))
    s += ");\n\nblocks\n(\n    hex (0 1 2 3 4 5 6 7) (%d %d %d) simpleGrading (1 1 1)\n);\n\nedges\n(\n);\n\n" % (nx, ny, nz)
    s += ("boundary\n(\n"
          "    inlet\n    {\n        type patch;\n        faces ((0 4 7 3));\n    }\n"
          "    outlet\n    {\n        type patch;\n        faces ((2 6 5 1));\n    }\n"
          "    ground\n    {\n        type wall;\n        faces ((0 3 2 1));\n    }\n"
          "    top\n    {\n        type patch;\n        faces ((4 5 6 7));\n    }\n"
          "    sides\n    {\n        type patch;\n        faces ((1 5 4 0) (3 7 6 2));\n    }\n"
          ");\n\nmergePatchPairs\n(\n);\n")
    return s


def _d_sfe():
    return _hdr("dictionary", "system", "surfaceFeatureExtractDict") + (
        "context.stl\n{\n"
        "    extractionMethod    extractFromSurface;\n"
        "    extractFromSurfaceCoeffs\n    {\n        includedAngle   150;\n    }\n"
        "    subsetFeatures\n    {\n        nonManifoldEdges    no;\n        openEdges           yes;\n    }\n"
        "    writeObj            no;\n}\n")


def _d_snappy(P, G):
    r = G["rbox"]
    l = G["loc"]
    s0, s1 = P["slev"]
    s = _hdr("dictionary", "system", "snappyHexMeshDict")
    s += "castellatedMesh true;\nsnap            true;\naddLayers       false;\n\n"
    s += ("geometry\n{\n"
          "    context.stl\n    {\n        type triSurfaceMesh;\n        name context;\n    }\n"
          "    refineBox\n    {\n        type searchableBox;\n        min (%s %s %s);\n        max (%s %s %s);\n    }\n"
          "}\n\n" % (_c(r["min"][0]), _c(r["min"][1]), _c(r["min"][2]), _c(r["max"][0]), _c(r["max"][1]), _c(r["max"][2])))
    s += ("castellatedMeshControls\n{\n"
          "    maxLocalCells       20000000;\n    maxGlobalCells      60000000;\n    minRefinementCells  10;\n"
          "    maxLoadUnbalance    0.10;\n    nCellsBetweenLevels 3;\n\n"
          "    features\n    (\n        {\n            file \"context.eMesh\";\n            level %d;\n        }\n    );\n\n"
          "    refinementSurfaces\n    {\n        context\n        {\n            level (%d %d);\n"
          "            patchInfo\n            {\n                type wall;\n            }\n        }\n    }\n\n"
          "    resolveFeatureAngle 30;\n\n"
          "    refinementRegions\n    {\n        refineBox\n        {\n            mode inside;\n            levels ((1E15 %d));\n        }\n    }\n\n"
          "    locationInMesh (%s %s %s);\n"
          "    allowFreeStandingZoneFaces true;\n}\n\n" % (s0, s0, s1, P["rlev"], _c(l[0]), _c(l[1]), _c(l[2])))
    s += ("snapControls\n{\n"
          "    nSmoothPatch            3;\n    tolerance               2.0;\n    nSolveIter              100;\n"
          "    nRelaxIter              5;\n    nFeatureSnapIter        10;\n    implicitFeatureSnap     false;\n"
          "    explicitFeatureSnap     true;\n    multiRegionFeatureSnap  false;\n}\n\n")
    s += ("addLayersControls\n{\n"
          "    relativeSizes               true;\n    layers\n    {\n    }\n    expansionRatio              1.0;\n"
          "    finalLayerThickness         0.3;\n    minThickness                0.1;\n    nGrow                       0;\n"
          "    featureAngle                60;\n    slipFeatureAngle            30;\n    nRelaxIter                  3;\n"
          "    nSmoothSurfaceNormals       1;\n    nSmoothNormals              3;\n    nSmoothThickness            10;\n"
          "    maxFaceThicknessRatio       0.5;\n    maxThicknessToMedialRatio   0.3;\n    minMedianAxisAngle          90;\n"
          "    nBufferCellsNoExtrude       0;\n    nLayerIter                  50;\n}\n\n")
    s += "meshQualityControls\n{\n    #include \"meshQualityDict\"\n}\n\nmergeTolerance 1e-6;\n"
    return s


def _d_meshquality():
    return _hdr("dictionary", "system", "meshQualityDict") + (
        "maxNonOrtho         65;\n"
        "maxBoundarySkewness 20;\n"
        "maxInternalSkewness 4;\n"
        "maxConcave          80;\n"
        "minVol              1e-13;\n"
        "minTetQuality       1e-15;\n"
        "minArea             -1;\n"
        "minTwist            0.02;\n"
        "minDeterminant      0.001;\n"
        "minFaceWeight       0.05;\n"
        "minVolRatio         0.01;\n"
        "minTriangleTwist    -1;\n"
        "nSmoothScale        4;\n"
        "errorReduction      0.75;\n")


def _d_control(P, G):
    et = P["end_time"]
    wi = min(100, et)
    s = _hdr("dictionary", "system", "controlDict")
    s += ("application     simpleFoam;\n\nstartFrom       latestTime;\nstartTime       0;\nstopAt          endTime;\n"
          "endTime         %d;\ndeltaT          1;\nwriteControl    timeStep;\nwriteInterval   %d;\npurgeWrite      0;\n"
          "writeFormat     ascii;\nwritePrecision  7;\nwriteCompression off;\ntimeFormat      general;\n"
          "timePrecision   6;\nrunTimeModifiable true;\n\n" % (et, wi))
    s += "functions\n{\n"
    if G["pmap"]:
        s += ("    probes\n    {\n        type            probes;\n        libs            (\"libsampling.so\");\n"
              "        writeControl    timeStep;\n        writeInterval   1;\n        fields          (U p);\n"
              "        probeLocations\n        (\n")
        for e in G["pmap"]:
            s += "            (%s %s %s)\n" % (_c(e[1]), _c(e[2]), _c(e[3]))
        s += "        );\n    }\n"
    s += "}\n"
    return s


def _d_fvschemes():
    return _hdr("dictionary", "system", "fvSchemes") + (
        "ddtSchemes\n{\n    default         steadyState;\n}\n\n"
        "gradSchemes\n{\n    default         Gauss linear;\n    grad(U)         cellLimited Gauss linear 1;\n}\n\n"
        "divSchemes\n{\n    default         none;\n"
        "    div(phi,U)      bounded Gauss upwind;\n"
        "    div(phi,k)      bounded Gauss upwind;\n"
        "    div(phi,epsilon) bounded Gauss upwind;\n"
        "    div((nuEff*dev2(T(grad(U))))) Gauss linear;\n}\n\n"
        "laplacianSchemes\n{\n    default         Gauss linear limited corrected 0.33;\n}\n\n"
        "interpolationSchemes\n{\n    default         linear;\n}\n\n"
        "snGradSchemes\n{\n    default         limited corrected 0.33;\n}\n\n"
        "wallDist\n{\n    method meshWave;\n}\n")


def _d_fvsolution():
    return _hdr("dictionary", "system", "fvSolution") + (
        "solvers\n{\n"
        "    p\n    {\n        solver          GAMG;\n        tolerance       1e-07;\n        relTol          0.1;\n"
        "        smoother        GaussSeidel;\n        nCellsInCoarsestLevel 10;\n        agglomerator    faceAreaPair;\n"
        "        mergeLevels     1;\n        cacheAgglomeration true;\n    }\n\n"
        "    \"(U|k|epsilon)\"\n    {\n        solver          smoothSolver;\n        smoother        symGaussSeidel;\n"
        "        tolerance       1e-08;\n        relTol          0.1;\n    }\n}\n\n"
        "SIMPLE\n{\n    nNonOrthogonalCorrectors 2;\n    consistent      no;\n\n"
        "    residualControl\n    {\n        p               1e-4;\n        U               1e-4;\n"
        "        \"(k|epsilon)\"     1e-4;\n    }\n}\n\n"
        "relaxationFactors\n{\n    fields\n    {\n        p               0.3;\n    }\n"
        "    equations\n    {\n        U               0.7;\n        k               0.7;\n        epsilon         0.7;\n    }\n}\n")


def _d_decompose(P):
    return _hdr("dictionary", "system", "decomposeParDict") + (
        "numberOfSubdomains %d;\n\nmethod          scotch;\n" % P["cores"])


def _d_toposet(G):
    l = G["loc"]
    out_pt = "((%s %s %s))" % (_c(l[0]), _c(l[1]), _c(l[2]))
    s = _hdr("dictionary", "system", "topoSetDict") + "actions\n(\n"
    for k, t in enumerate(G["trees"]):
        n = t["name"]
        s += ("    {\n        name    %s_set;\n        type    cellSet;\n        action  new;\n"
              "        source  surfaceToCell;\n        sourceInfo\n        {\n"
              "            file            \"$FOAM_CASE/constant/triSurface/%s.stl\";\n"
              "            outsidePoints   %s;\n            includeCut      true;\n            includeInside   true;\n"
              "            includeOutside  false;\n            nearDistance    -1;\n            curvature       -100;\n"
              "        }\n    }\n" % (n, n, out_pt))
        if k > 0:
            # Overlapping canopies: cells already owned by an earlier tree stay with that tree (no double drag).
            s += ("    {\n        name    %s_set;\n        type    cellSet;\n        action  delete;\n"
                  "        source  cellToCell;\n        sourceInfo\n        {\n            set trees_all;\n        }\n    }\n" % n)
        s += ("    {\n        name    trees_all;\n        type    cellSet;\n        action  %s;\n"
              "        source  cellToCell;\n        sourceInfo\n        {\n            set %s_set;\n        }\n    }\n"
              % ("new" if k == 0 else "add", n))
        s += ("    {\n        name    %s;\n        type    cellZoneSet;\n        action  new;\n"
              "        source  setToCellZone;\n        sourceInfo\n        {\n            set %s_set;\n        }\n    }\n" % (n, n))
    s += ");\n"
    return s


def _d_fvoptions(G):
    s = _hdr("dictionary", "constant", "fvOptions")
    for t in G["trees"]:
        f = _n(t["f"])
        s += ("porosity_%s\n{\n    type            explicitPorositySource;\n    active          yes;\n\n"
              "    explicitPorositySourceCoeffs\n    {\n        selectionMode   cellZone;\n        cellZone        %s;\n\n"
              "        type            DarcyForchheimer;\n\n        DarcyForchheimerCoeffs\n        {\n"
              "            d   (0 0 0);\n            f   (%s %s %s);\n\n"
              "            coordinateSystem\n            {\n                type    cartesian;\n                origin  (0 0 0);\n"
              "                coordinateRotation\n                {\n                    type    axesRotation;\n"
              "                    e1      (1 0 0);\n                    e2      (0 1 0);\n                }\n            }\n"
              "        }\n    }\n}\n\n" % (t["name"], t["name"], f, f, f))
    return s


def _d_turbulence():
    return _hdr("dictionary", "constant", "turbulenceProperties") + (
        "simulationType  RAS;\n\nRAS\n{\n    RASModel        RNGkEpsilon;\n    turbulence      on;\n    printCoeffs     on;\n}\n")


def _d_transport():
    return _hdr("dictionary", "constant", "transportProperties") + (
        "transportModel  Newtonian;\n\nnu              [0 2 -1 0 0 0 0] 1.5e-05;\n")


def _field(cls, name, dims, internal, bfs):
    s = _hdr(cls, "0", name)
    s += "dimensions      %s;\n\ninternalField   %s;\n\nboundaryField\n{\n" % (dims, internal)
    for patch, body in bfs:
        s += "    %s\n    {\n" % patch
        for line in body:
            s += "        %s\n" % line
        s += "    }\n"
    s += "}\n"
    return s


def _fields(P):
    kappa, cmu = 0.41, 0.09
    ur, zr, z0 = P["u_ref"], P["z_ref"], P["z0"]
    us = kappa * ur / math.log((zr + z0) / z0)
    k0 = us * us / math.sqrt(cmu)
    e0 = us ** 3 / (kappa * (zr + z0))
    abl = ["flowDir         (1 0 0);", "zDir            (0 0 1);", "Uref            %s;" % _n(ur),
           "Zref            %s;" % _n(zr), "z0              uniform %s;" % _n(z0),
           "zGround         uniform 0;", "value           $internalField;"]
    slip = ["type            slip;"]
    ctx = '"context.*"'
    U = _field("volVectorField", "U", "[0 1 -1 0 0 0 0]", "uniform (%s 0 0)" % _n(ur), [
        ("inlet", ["type            atmBoundaryLayerInletVelocity;"] + abl),
        ("outlet", ["type            inletOutlet;", "inletValue      uniform (0 0 0);", "value           $internalField;"]),
        ("ground", ["type            noSlip;"]),
        (ctx, ["type            noSlip;"]),
        ("top", slip), ("sides", slip)])
    p = _field("volScalarField", "p", "[0 2 -2 0 0 0 0]", "uniform 0", [
        ("inlet", ["type            zeroGradient;"]),
        ("outlet", ["type            fixedValue;", "value           uniform 0;"]),
        ("ground", ["type            zeroGradient;"]),
        (ctx, ["type            zeroGradient;"]),
        ("top", slip), ("sides", slip)])
    k = _field("volScalarField", "k", "[0 2 -2 0 0 0 0]", "uniform %s" % _n(k0), [
        ("inlet", ["type            atmBoundaryLayerInletK;"] + abl),
        ("outlet", ["type            inletOutlet;", "inletValue      $internalField;", "value           $internalField;"]),
        ("ground", ["type            kqRWallFunction;", "value           $internalField;"]),
        (ctx, ["type            kqRWallFunction;", "value           $internalField;"]),
        ("top", slip), ("sides", slip)])
    eps = _field("volScalarField", "epsilon", "[0 2 -3 0 0 0 0]", "uniform %s" % _n(e0), [
        ("inlet", ["type            atmBoundaryLayerInletEpsilon;"] + abl),
        ("outlet", ["type            inletOutlet;", "inletValue      $internalField;", "value           $internalField;"]),
        ("ground", ["type            epsilonWallFunction;", "value           $internalField;"]),
        (ctx, ["type            epsilonWallFunction;", "value           $internalField;"]),
        ("top", slip), ("sides", slip)])
    nut = _field("volScalarField", "nut", "[0 2 -1 0 0 0 0]", "uniform 0", [
        ("inlet", ["type            calculated;", "value           uniform 0;"]),
        ("outlet", ["type            calculated;", "value           uniform 0;"]),
        ("ground", ["type            nutkAtmRoughWallFunction;", "z0              uniform %s;" % _n(z0), "value           uniform 0;"]),
        (ctx, ["type            nutkWallFunction;", "value           uniform 0;"]),
        ("top", ["type            calculated;", "value           uniform 0;"]),
        ("sides", ["type            calculated;", "value           uniform 0;"])])
    return {"U": U, "p": p, "k": k, "epsilon": eps, "nut": nut}


# =============================================================================
# BATCH FILE
# =============================================================================
def _bat(case, setvars, cores, skip_mesh):
    cw = _win(case)
    L = ["@echo off", "setlocal",
         'cd /d "%s"' % cw,
         'if not exist "log" mkdir "log"',
         '>"log\\status.txt" echo RUNNING',
         '>"log\\stage.txt" echo setvars',
         'call "%s" > "%s\\log\\setvars.log" 2>&1' % (_win(setvars), cw),
         'cd /d "%s"' % cw,
         'where blockMesh > "log\\env_check.log" 2>&1',
         'if errorlevel 1 (',
         '    >"log\\status.txt" echo FAILED setvars - OpenFOAM commands not found after calling setvars.bat',
         '    goto :finish',
         ')']

    def step(name, cmd, check=True):
        s = ['>"log\\stage.txt" echo %s' % name,
             '%s > "log\\%s.log" 2>&1' % (cmd, name)]
        if check:
            s += ['if errorlevel 1 (',
                  '    >"log\\status.txt" echo FAILED %s' % name,
                  '    goto :finish',
                  ')']
        return s

    if not skip_mesh:
        L += step("surfaceFeatureExtract", "surfaceFeatureExtract")
        L += step("blockMesh", "blockMesh")
        L += step("snappyHexMesh", "snappyHexMesh -overwrite")
        L += step("checkMesh", "checkMesh", check=False)
        L += ['findstr /B /C:"End" "log\\checkMesh.log" >nul',
              'if errorlevel 1 (',
              '    >"log\\status.txt" echo MESHFAIL checkMesh did not complete',
              '    goto :finish',
              ')',
              'findstr /I /C:"negative cell volume" /C:"negative volume" /C:"incorrectly oriented" /C:"non-orthogonality errors" /C:"severely non-orthogonal" "log\\checkMesh.log" >nul',
              'if not errorlevel 1 (',
              '    >"log\\status.txt" echo MESHFAIL negative volumes, wrongly oriented faces or non-orthogonality errors',
              '    goto :finish',
              ')',
              'findstr /R /C:"Number of regions: *[2-9]" /C:"Number of regions: *[1-9][0-9]" "log\\checkMesh.log" >nul',
              'if not errorlevel 1 (',
              '    >"log\\status.txt" echo MESHFAIL mesh has more than 1 region',
              '    goto :finish',
              ')']
    L += step("topoSet", "topoSet")
    if cores > 1:
        L += step("decomposePar", "decomposePar -force")
        L += step("simpleFoam", "mpiexec -n %d simpleFoam -parallel" % cores)
        L += step("reconstructPar", "reconstructPar -latestTime")
    else:
        L += step("simpleFoam", "simpleFoam")
    L += ['>"log\\status.txt" echo DONE', ':finish', 'endlocal']
    return "\r\n".join(L) + "\r\n"


# =============================================================================
# CASE MANAGEMENT
# =============================================================================
_MESH_LOGS = ("surfaceFeatureExtract.log", "blockMesh.log", "snappyHexMesh.log", "checkMesh.log", "mesh_signature.json")


def _mesh_sig(P, G):
    return _hash({"v": 3, "ctx": G["ctx_fp"], "wd": round(P["wind_dir"], 4), "cs": P["cell"],
                  "rl": P["rlev"], "sl": P["slev"], "dom": G["domain"], "rbox": G["rbox"],
                  "loc": [round(x, 4) for x in G["loc"]]})


def _mesh_valid(case, sig):
    if not os.path.isfile(os.path.join(case, "constant", "polyMesh", "owner")):
        return False, "no mesh found"
    t = _read(os.path.join(case, "log", "mesh_signature.json"))
    if not t:
        return False, "no mesh signature"
    try:
        if json.loads(t).get("sig") != sig:
            return False, "context, refinement, wind direction or mesh settings changed"
    except Exception:
        return False, "unreadable mesh signature"
    cm = _parse_checkmesh(_read(os.path.join(case, "log", "checkMesh.log")))
    if not cm["ok"]:
        return False, "previous checkMesh did not pass"
    return True, "valid mesh found"


def _clean_case(case, reuse):
    for d in glob.glob(os.path.join(case, "processor*")):
        _rm(d)
    if os.path.isdir(case):
        for name in os.listdir(case):
            if _is_num(name) and os.path.isdir(os.path.join(case, name)):
                _rm(os.path.join(case, name))
    _rm(os.path.join(case, "postProcessing"))
    pm = os.path.join(case, "constant", "polyMesh")
    _rm(os.path.join(pm, "sets"))
    for f in ("cellZones", "cellZones.gz"):
        _rm(os.path.join(pm, f))
    for f in glob.glob(os.path.join(case, "constant", "triSurface", "tree_*.stl")):
        _rm(f)
    logd = os.path.join(case, "log")
    if reuse:
        if os.path.isdir(logd):
            for f in os.listdir(logd):
                if f not in _MESH_LOGS:
                    _rm(os.path.join(logd, f))
    else:
        _rm(pm)
        _rm(os.path.join(case, "constant", "extendedFeatureEdgeMesh"))
        for f in glob.glob(os.path.join(case, "constant", "triSurface", "*.eMesh")):
            _rm(f)
        _rm(logd)


def _write_case(P, G, case, setvars, warns):
    sig = _mesh_sig(P, G)
    reuse_ok, reuse_note = (False, "reuse_mesh_ is False")
    if P["reuse"]:
        reuse_ok, reuse_note = _mesh_valid(case, sig)
    _clean_case(case, reuse_ok)

    sysd = os.path.join(case, "system")
    cons = os.path.join(case, "constant")
    zero = os.path.join(case, "0")
    tri = os.path.join(case, "constant", "triSurface")
    logd = os.path.join(case, "log")
    for d in (sysd, cons, zero, tri, logd):
        os.makedirs(d, exist_ok=True)

    # Context STL (single solid "context")
    ctx_mesh = rg.Mesh()
    for i, g in enumerate(G["ctx_rot"]):
        m = _mesh_geo(g)
        if m is None:
            warns.append("context_ item %d could not be meshed for STL export." % i)
            continue
        ctx_mesh.Append(m)
    if ctx_mesh.Faces.Count == 0:
        raise ValueError("Context geometry produced an empty STL.")
    n_ctx = _write_stl(os.path.join(tri, "context.stl"), "context", ctx_mesh)

    # Tree STLs (closed, one per tree)
    for t in G["trees"]:
        _write_stl(os.path.join(tri, t["name"] + ".stl"), t["name"], t["mesh"])

    _write(os.path.join(sysd, "blockMeshDict"), _d_blockmesh(G))
    _write(os.path.join(sysd, "surfaceFeatureExtractDict"), _d_sfe())
    _write(os.path.join(sysd, "snappyHexMeshDict"), _d_snappy(P, G))
    _write(os.path.join(sysd, "meshQualityDict"), _d_meshquality())
    _write(os.path.join(sysd, "controlDict"), _d_control(P, G))
    _write(os.path.join(sysd, "fvSchemes"), _d_fvschemes())
    _write(os.path.join(sysd, "fvSolution"), _d_fvsolution())
    _write(os.path.join(sysd, "decomposeParDict"), _d_decompose(P))
    _write(os.path.join(sysd, "topoSetDict"), _d_toposet(G))
    _write(os.path.join(cons, "fvOptions"), _d_fvoptions(G))
    _write(os.path.join(cons, "turbulenceProperties"), _d_turbulence())
    _write(os.path.join(cons, "transportProperties"), _d_transport())
    for name, text in _fields(P).items():
        _write(os.path.join(zero, name), text)

    _write(os.path.join(logd, "mesh_signature.json"), json.dumps({"sig": sig}))
    info = {
        "wind_dir": P["wind_dir"], "alpha": G["alpha"], "centre": G["centre"], "H": G["H"],
        "n_probes": G["n_probes"], "probe_map": G["pmap"],
        "skipped": {str(k): v for k, v in G["skipped"].items()},
        "trees": [{"name": t["name"], "index": t["index"], "f": t["f"], "cut_z_world": t["cut_z_world"]} for t in G["trees"]],
        "domain": G["domain"], "rbox": G["rbox"], "loc": G["loc"],
        "end_time": P["end_time"], "cores": P["cores"], "mesh_reused": reuse_ok, "reuse_note": reuse_note,
        "context_triangles": n_ctx, "started": time.strftime("%Y-%m-%d %H:%M:%S"),
        "u_ref": P["u_ref"], "z_ref": P["z_ref"], "z0": P["z0"], "cell": P["cell"],
        "rlev": P["rlev"], "slev": list(P["slev"]),
    }
    _write(os.path.join(logd, "run_info.json"), json.dumps(info, indent=1))
    bat = os.path.join(case, "run_case.bat")
    _write(bat, _bat(case, setvars, P["cores"], reuse_ok), crlf=False)
    _write(os.path.join(logd, "status.txt"), "STARTING\n")
    return bat, info


def _launch(case, bat, key):
    proc = subprocess.Popen(["cmd.exe", "/c", _win(bat)], cwd=case,
                            stdin=subprocess.DEVNULL, stdout=subprocess.DEVNULL, stderr=subprocess.DEVNULL,
                            creationflags=_NO_WINDOW)
    sc.sticky[key] = proc
    _write(os.path.join(case, "log", "pid.txt"), str(proc.pid))
    return proc


def _pid_alive(pid):
    try:
        out = subprocess.run(["tasklist", "/FI", "PID eq %d" % pid, "/NH"], capture_output=True,
                             text=True, creationflags=_NO_WINDOW, timeout=10).stdout
        return str(pid) in out
    except Exception:
        return False


def _running(case, key):
    proc = sc.sticky.get(key)
    if proc is not None:
        try:
            if proc.poll() is None:
                return True
            return False
        except Exception:
            pass
    st = (_read(os.path.join(case, "log", "status.txt")) or "").strip()
    if st.startswith("RUNNING") or st.startswith("STARTING"):
        pid = _to_int((_read(os.path.join(case, "log", "pid.txt")) or "").strip(), -1)
        return pid > 0 and _pid_alive(pid)
    return False


# =============================================================================
# LOG PARSING
# =============================================================================
def _parse_checkmesh(text):
    r = {"complete": False, "ok": False, "fails": [], "lines": []}
    if not text:
        return r
    r["complete"] = bool(re.search(r"^\s*End\s*$", text, re.M))
    if re.search(r"negative cell volume|negative volume", text, re.I):
        r["fails"].append("negative volume cells")
    if re.search(r"incorrectly oriented", text, re.I):
        r["fails"].append("wrongly oriented faces")
    if re.search(r"non-orthogonality errors|severely non-orthogonal", text, re.I):
        r["fails"].append("non-orthogonality errors")
    reg = re.findall(r"Number of regions:\s*(\d+)", text)
    if reg and int(reg[-1]) > 1:
        r["fails"].append("%s disconnected mesh regions" % reg[-1])
    m = re.search(r"^\s*cells:\s*(\d+)", text, re.M)
    if m:
        r["lines"].append("Cells: %s" % m.group(1))
    m = re.search(r"Mesh non-orthogonality Max:\s*([-+0-9.eE]+)\s*average:\s*([-+0-9.eE]+)", text)
    if m:
        r["lines"].append("Non-orthogonality max %s, average %s" % (m.group(1), m.group(2)))
    m = re.search(r"Max skewness\s*=\s*([-+0-9.eE]+)", text)
    if m:
        r["lines"].append("Max skewness %s" % m.group(1))
    if reg:
        r["lines"].append("Regions: %s" % reg[-1])
    m = re.search(r"Failed\s+(\d+)\s+mesh checks", text)
    if m:
        r["lines"].append("checkMesh: Failed %s mesh checks" % m.group(1))
    elif "Mesh OK" in text:
        r["lines"].append("checkMesh: Mesh OK")
    r["ok"] = r["complete"] and not r["fails"]
    return r


def _parse_topo(case):
    raw, final = {}, {}
    text = _read(os.path.join(case, "log", "topoSet.log")) or ""
    for m in re.finditer(r"(\w+)\s+(tree_\d+)(_set)?\s+now size\s+(\d+)", text):
        name, is_set, n = m.group(2), bool(m.group(3)), int(m.group(4))
        if is_set:
            raw.setdefault(name, n)
        else:
            final[name] = n
    if not final:
        cz = _read(os.path.join(case, "constant", "polyMesh", "cellZones")) or ""
        for m in re.finditer(r"(tree_\d+)\s*\{\s*type\s+cellZone\s*;\s*cellLabels\s+List<label>\s*(\d+)", cz):
            final[m.group(1)] = int(m.group(2))
    return raw, final


def _parse_residuals(text):
    if not text:
        return None, {}
    blocks = re.split(r"\n\s*Time = ", "\n" + text)
    fallback = (None, {})
    for blk in reversed(blocks[1:]):
        if "Solving for" not in blk:
            continue
        t = blk.split("\n", 1)[0].strip()
        res = {}
        for f in ("Ux", "Uy", "Uz", "p", "k", "epsilon"):
            m = re.search(r"Solving for %s, Initial residual = ([-+0-9.eE]+)" % re.escape(f), blk)
            if m:
                res[f] = float(m.group(1))
        if "p" in res and "epsilon" in res:
            return t, res
        if fallback[0] is None:
            fallback = (t, res)
    return fallback


def _read_probes(case, info):
    base = os.path.join(case, "postProcessing", "probes")
    if not os.path.isdir(base):
        return None, "postProcessing/probes folder not found"
    dirs = [d for d in os.listdir(base) if _is_num(d) and os.path.isfile(os.path.join(base, d, "U"))]
    if not dirs:
        return None, "postProcessing/probes/<time>/U not found"
    d = max(dirs, key=lambda x: float(x))
    text = _read(os.path.join(base, d, "U")) or ""
    header = re.findall(r"#\s*Probe\s+(\d+)\s*\(([^)]*)\)", text)
    data = [l for l in text.splitlines() if l.strip() and not l.lstrip().startswith("#")]
    if not data:
        return None, "probe file postProcessing/probes/%s/U has no data rows yet" % d
    last = data[-1]
    t = last.split()[0]
    vals = []
    for v in re.findall(r"\(([^)]*)\)", last):
        try:
            c = [float(x) for x in v.split()]
        except Exception:
            c = None
        if c is None or len(c) != 3 or any(abs(x) > 1e100 for x in c):
            vals.append(None)
        else:
            vals.append(c)
    pmap = info["probe_map"]
    out = {}
    if header and len(header) == len(vals):
        for (hid, hxyz), val in zip(header, vals):
            try:
                hc = [float(x) for x in hxyz.split()]
            except Exception:
                continue
            hi = int(hid)
            cand = None
            if 0 <= hi < len(pmap):
                e = pmap[hi]
                tolp = 0.05 + 1e-5 * max(abs(hc[0]), abs(hc[1]), abs(hc[2]))
                if all(abs(e[k + 1] - hc[k]) <= tolp for k in range(3)):
                    cand = e
            if cand is None:
                best, bd = None, 1e30
                for e in pmap:
                    dd = (e[1] - hc[0]) ** 2 + (e[2] - hc[1]) ** 2 + (e[3] - hc[2]) ** 2
                    if dd < bd:
                        best, bd = e, dd
                if best is not None and bd < 0.25:
                    cand = best
            if cand is not None:
                out[cand[0]] = val
    elif len(vals) == len(pmap):
        for e, val in zip(pmap, vals):
            out[e[0]] = val
    else:
        return None, "probe column count (%d) does not match written probes (%d)" % (len(vals), len(pmap))
    return (t, out), ""


def _fatal_logs(case):
    hits = []
    logd = os.path.join(case, "log")
    if not os.path.isdir(logd):
        return hits
    for f in sorted(os.listdir(logd)):
        if not f.endswith(".log"):
            continue
        t = _read(os.path.join(logd, f)) or ""
        if "FOAM FATAL" in t or "FOAM exiting" in t:
            hits.append(f)
    return hits


# =============================================================================
# MAIN
# =============================================================================
def main():
    comp = ghenv.Component
    if _configure():
        return None

    warns, errs, R = [], [], []
    P = _read_inputs()

    if not P["context"]:
        errs.append("context_ is required.")
    if P["refine"] is None:
        errs.append("refine_ is required.")
    if not P["probes"]:
        errs.append("probes_ is required.")
    if P["wind_dir"] is None:
        errs.append("wind_dir_ is required (0 to 359, direction the wind blows FROM).")
    if errs:
        for e in errs:
            comp.AddRuntimeMessage(GH_RuntimeMessageLevel.Warning, e)
        return [], [], "STAGE: waiting for inputs\n" + "\n".join(errs), False, ""

    case = P["case_root"] + "/" + _case_name(P["wind_dir"])
    guid = str(comp.InstanceGuid)
    k_proc = "ofw_proc|" + case
    k_prev = "ofw_prev_run|" + guid
    k_sig = "ofw_last_sig|" + guid

    if " " in case:
        warns.append("Case path contains spaces. OpenFOAM on Windows can fail with spaces; use a path without spaces.")

    running = _running(case, k_proc)
    started = False

    # ---------------- Launch ----------------
    run_sig = None
    if P["run"]:
        try:
            run_sig = _hash({
                "ctx": _fp_geo([g for g in (_coerce_geo(o) for o in P["context"]) if g is not None]),
                "trees": _fp_geo([g for g in (_coerce_geo(o) for o in P["trees"]) if g is not None]),
                "ref": _fp_geo([g for g in [_coerce_geo(P["refine"])] if g is not None]),
                "pr": [[round(p.X, 3), round(p.Y, 3), round(p.Z, 3)] for p in (_coerce_pt(o) for o in P["probes"]) if p is not None],
                "p": {k: v for k, v in P.items() if k not in ("context", "trees", "refine", "probes", "run", "refresh")},
            })
        except Exception:
            run_sig = str(time.time())

    prev_run = sc.sticky.get(k_prev, False)
    if P["run"] and running:
        warns.append("A run is already active for this case. run_ was ignored until it finishes.")
    elif P["run"] and (not prev_run or sc.sticky.get(k_sig) != run_sig):
        setvars = _find_setvars(P["bluecfd"])
        if setvars is None:
            errs.append("blueCFD setvars.bat not found. Set bluecfd_ to the full path of setvars.bat.")
        else:
            try:
                G = _build_geometry(P, warns)
            except Exception as e:
                G = None
                errs.append("Geometry preparation failed: %s" % e)
            if G is not None:
                try:
                    os.makedirs(case, exist_ok=True)
                    bat, _info = _write_case(P, G, case, setvars, warns)
                except Exception as e:
                    bat = None
                    errs.append("Writing the case failed: %s\n%s" % (e, traceback.format_exc(limit=2)))
                if bat:
                    try:
                        _launch(case, bat, k_proc)
                        started, running = True, True
                        sc.sticky[k_sig] = run_sig
                        _write(os.path.join(case, "log", "launch_warnings.json"), json.dumps(warns))
                    except Exception as e:
                        errs.append("Launching the run failed: %s" % e)
    sc.sticky[k_prev] = P["run"]

    # ---------------- Read state ----------------
    info = None
    t = _read(os.path.join(case, "log", "run_info.json"))
    if t:
        try:
            info = json.loads(t)
        except Exception:
            info = None
    if not started:
        lw = _read(os.path.join(case, "log", "launch_warnings.json"))
        if lw:
            try:
                for w in json.loads(lw):
                    if w not in warns:
                        warns.append(w)
            except Exception:
                pass

    status = (_read(os.path.join(case, "log", "status.txt")) or "").strip()
    stage = (_read(os.path.join(case, "log", "stage.txt")) or "").strip()

    if info is None or (errs and not started):
        rep = ["STAGE: error" if errs else "STAGE: no case yet",
               "Case: %s" % case]
        if not errs:
            rep.append("Set run_ to True to write the case and start the run.")
        if errs:
            rep += ["", "ERRORS:"] + ["  - " + e for e in errs]
        if warns:
            rep += ["", "WARNINGS:"] + ["  - " + w for w in warns]
        for e in errs:
            comp.AddRuntimeMessage(GH_RuntimeMessageLevel.Error, e.split("\n")[0])
        return [], [], "\n".join(rep), running, case

    if info.get("n_probes") != len(P["probes"]):
        warns.append("probes_ count (%d) differs from the last run (%d). Results follow the last run order. Rerun to update."
                     % (len(P["probes"]), info.get("n_probes", 0)))
    if abs(float(info.get("wind_dir", P["wind_dir"])) - P["wind_dir"]) > 1e-6:
        warns.append("Case was written for a different wind direction.")

    # Stage text
    if running:
        st_txt = "RUNNING (%s)" % (stage or "starting")
    elif status.startswith("DONE"):
        st_txt = "DONE"
    elif status.startswith("MESHFAIL"):
        st_txt = "STOPPED AT MESH GATE: " + status[len("MESHFAIL"):].strip()
    elif status.startswith("FAILED"):
        st_txt = status
    elif status.startswith("RUNNING") or status.startswith("STARTING"):
        st_txt = "INTERRUPTED (process not found, last stage: %s)" % (stage or "unknown")
    else:
        st_txt = status or "unknown"

    R.append("STAGE: " + st_txt + ("  [run started now]" if started else ""))
    R.append("Case: %s" % case)
    R.append("Started: %s | wind from %.1f deg | U_ref %.2f m/s at %.1f m | z0 %.3f m | end_time %d | cores %d"
             % (info.get("started", "?"), info["wind_dir"], info.get("u_ref", 0), info.get("z_ref", 0),
                info.get("z0", 0), info.get("end_time", 0), info.get("cores", 0)))
    d = info["domain"]
    R.append("Domain (wind coords, m): x %.1f to %.1f, y %.1f to %.1f, z 0 to %.1f | background %dx%dx%d cells of %.2f m | H = %.1f m"
             % (d["min"][0], d["max"][0], d["min"][1], d["max"][1], d["max"][2], d["n"][0], d["n"][1], d["n"][2],
                info.get("cell", 0), info.get("H", 0)))
    fine = info.get("cell", 5.0) / (2 ** info.get("rlev", 3))
    R.append("Refinement: level %d in refine_ (about %.2f m cells) | surface levels (%d %d)"
             % (info.get("rlev", 0), fine, info["slev"][0], info["slev"][1]))
    R.append("Mesh: %s (%s)" % ("REUSED" if info.get("mesh_reused") else "NEW", info.get("reuse_note", "")))

    # Mesh check
    R.append("")
    R.append("MESH CHECK:")
    cm = _parse_checkmesh(_read(os.path.join(case, "log", "checkMesh.log")))
    if cm["lines"] or cm["fails"]:
        for l in cm["lines"]:
            R.append("  " + l)
        if cm["fails"]:
            R.append("  FAILED: " + ", ".join(cm["fails"]))
        elif cm["complete"]:
            R.append("  Gate passed (no negative volumes, wrongly oriented faces, non-orthogonality errors, single region).")
    else:
        R.append("  checkMesh.log not available yet.")
    snap = _read(os.path.join(case, "log", "snappyHexMesh.log"))
    if snap and "Finished meshing" not in snap and not running and not info.get("mesh_reused"):
        R.append("  snappyHexMesh did not finish. See log/snappyHexMesh.log")

    # Trees
    R.append("")
    R.append("TREE ZONES:")
    trees = info.get("trees", [])
    if not trees:
        R.append("  No trees_ (no porous zones).")
    else:
        raw, final = _parse_topo(case)
        for tr in trees:
            n = tr["name"]
            if n in final:
                txt = "  %s: %d cells in zone" % (n, final[n])
                if n in raw and raw[n] != final[n]:
                    txt += " (%d before removing overlap with earlier trees)" % raw[n]
                txt += " | f = %s 1/m | trunk cut at z = %.2f m" % (_n(tr["f"]), tr["cut_z_world"])
                R.append(txt)
                if final[n] == 0:
                    warns.append("%s has 0 cells. It is outside the refinement box or mesh, or fully overlapped by an earlier tree." % n)
            else:
                R.append("  %s: pending (topoSet not run yet) | f = %s 1/m" % (n, _n(tr["f"])))
        R.append("  Overlapping canopies: shared cells are assigned to the lower-numbered tree only (no double drag).")

    # Residuals
    R.append("")
    R.append("RESIDUALS (last iteration, initial):")
    sf = _read(os.path.join(case, "log", "simpleFoam.log"))
    if sf:
        it, res = _parse_residuals(sf)
        if it is not None:
            R.append("  Iteration %s: " % it + ", ".join("%s %.3e" % (k, v) for k, v in res.items()))
            for k in ("Ux", "Uy", "p", "k", "epsilon"):
                if k in res and res[k] > 1e-3:
                    warns.append("Final initial residual of %s is %.2e (above 1e-3). Results are not converged." % (k, res[k]))
        else:
            R.append("  No solver iterations yet.")
        if "SIMPLE solution converged" in sf:
            R.append("  simpleFoam reached residualControl convergence.")
        n_por = sf.count("Selecting finite volume options model type explicitPorositySource")
        R.append("  Porosity sources selected in simpleFoam.log: %d of %d trees" % (n_por, len(trees)))
        if trees and n_por == 0 and re.search(r"Time = ", sf):
            warns.append("No explicitPorositySource was selected in simpleFoam.log. Tree zones are NOT active; check constant/fvOptions and topoSet.log.")
        elif trees and 0 < n_por < len(trees):
            warns.append("Only %d of %d porosity sources were selected." % (n_por, len(trees)))
    else:
        R.append("  simpleFoam.log not available yet.")

    # Probes
    n = info.get("n_probes", 0)
    U_out, M_out = [None] * n, [None] * n
    alpha = info["alpha"]
    ca, sa = math.cos(alpha), math.sin(alpha)
    R.append("")
    R.append("PROBES:")
    skipped = info.get("skipped", {})
    R.append("  %d probes, %d written to OpenFOAM, %d skipped before the run" % (n, len(info["probe_map"]), len(skipped)))
    for k, v in sorted(skipped.items(), key=lambda kv: int(kv[0]))[:20]:
        R.append("    probe %s: %s" % (k, v))
    if len(skipped) > 20:
        R.append("    ... %d more" % (len(skipped) - 20))
    try:
        pr, why = _read_probes(case, info)
        if pr is None:
            log_hint = "log/simpleFoam.log" if os.path.isfile(os.path.join(case, "log", "simpleFoam.log")) else \
                "log/%s.log" % (stage or "setvars")
            R.append("  No probe results: %s. Check %s." % (why, log_hint))
        else:
            ptime, vals = pr
            n_ok, n_none = 0, 0
            for e in info["probe_map"]:
                oi = e[0]
                v = vals.get(oi)
                if v is None:
                    n_none += 1
                    continue
                # rotate back to world coordinates (inverse of the rotation by alpha)
                wx = ca * v[0] + sa * v[1]
                wy = -sa * v[0] + ca * v[1]
                vec = rg.Vector3d(wx, wy, v[2])
                if oi < n:
                    U_out[oi] = vec
                    M_out[oi] = vec.Length
                    n_ok += 1
            R.append("  Values from iteration %s: %d valid, %d not found by OpenFOAM (returned None)" % (ptime, n_ok, n_none))
            mags = [m for m in M_out if m is not None]
            if mags:
                R.append("  |U| min %.2f, mean %.2f, max %.2f m/s" % (min(mags), sum(mags) / len(mags), max(mags)))
            if n_ok == 0:
                warns.append("All probe values are None. Check log/simpleFoam.log and the probe heights.")
    except Exception as e:
        R.append("  Reading probes failed: %s. Check log/simpleFoam.log." % e)

    # Failures and logs
    if not running and (status.startswith("FAILED") or status.startswith("MESHFAIL")):
        step = stage or "unknown"
        R.append("")
        R.append("LAST LINES OF log/%s.log:" % step)
        R.append(_tail(os.path.join(case, "log", step + ".log")))
    fat = _fatal_logs(case)
    if fat:
        warns.append("FOAM FATAL error found in: " + ", ".join(fat))

    if info.get("end_time", 0) < 1000:
        warns.append("end_time_ = %d. Use 1000 to 2000 iterations for converged report results." % info.get("end_time", 0))
    if trees:
        warns.append("Tree porosity adds momentum drag only (no extra k / epsilon source terms).")
    if running:
        warns.append("Run in progress. Press refresh_ to update logs and probe values.")

    if errs:
        R.append("")
        R.append("ERRORS:")
        R += ["  - " + e for e in errs]
        for e in errs:
            comp.AddRuntimeMessage(GH_RuntimeMessageLevel.Error, e.split("\n")[0])
    if warns:
        R.append("")
        R.append("WARNINGS:")
        seen = []
        for w in warns:
            if w not in seen:
                seen.append(w)
                R.append("  - " + w)

    return U_out, M_out, "\n".join(R), running, case


# =============================================================================
# RUN
# =============================================================================
U, U_mag, report, is_running, case_dir = [], [], "", False, ""
try:
    _result = main()
except Exception as _e:
    _result = ([], [], "STAGE: error\nUnexpected failure: %s\n%s" % (_e, traceback.format_exc()), False, "")
if _result is not None:
    U, U_mag, report, is_running, case_dir = _result
# ---------- end python_3_script ----------
panel_8 = Panel(python_3_script.report)
createbfgeometry = Butterfly_CreateButterflyGeometry(name="mass", geo=flatten(entwine_2), refine_levels="3,3")  # -> report, BF_geo; plug-in component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
refinementregion = Butterfly_RefinementRegion(name="pool", geo=flatten(brep_7), ref_mode=inoutrefmode)  # -> out, ref_region; plug-in component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
mesh_join = MeshJoin(Meshes=mesh_brep)
createcasefromtunnel = Butterfly_CreateCaseFromTunnel(
    name="Wind_Z6_SE",
    BF_geo=flatten(createbfgeometry.BF_geo),
    ref_regions=refinementregion.ref_region,
    wind_vector=windvector,
    ref_wind_height=10,
    landscape=6,
    tunnel_params=tunnelparams.tunnel_params,
    run=Toggle(False))  # -> report, block_pts, wind_tunnel, case; plug-in component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
toggle = BooleanToggle(True)
decomposepardict_scotch = Butterfly_decomposeParDictScotch(num_of_cpus="8")  # -> decompose_par_dict; plug-in component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
wtgrading = Butterfly_windTunnelGrading(wind_tunnel=createcasefromtunnel.wind_tunnel, cell_size="3", cell_to_cell_ratio=1.2, wake_offset=2, height_offset=5)  # -> report, grad_xyz, cell_count_xyz, cell_count_tot, preview; plug-in component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
blockmesh = Butterfly_blockMesh(
    case=createcasefromtunnel.case,
    grad_xyz=wtgrading.grad_xyz,
    cell_count=wtgrading.cell_count_xyz,
    overwrite=toggle,
    write=toggle,
    run=Toggle(False))  # -> report, case; plug-in component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
snappyhexmesh = Butterfly_snappyHexMesh(case=blockmesh.case, decompose_par_dict=decomposepardict_scotch, write=Toggle(True), run=Toggle(False))  # -> report, case; plug-in component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
controldict = Butterfly_controlDict(start_time=0, end_time="100", write_interval=100, write_compression=False, purge_write="3")  # -> control_dict; plug-in component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
probes = Butterfly_probes(points=point, fields="U", write_interval="100")  # -> probes; plug-in component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
ras = Butterfly_RASTurbulenceModel(RAS_model="RNGkEpsilon", turbulence=True, print_coeffs=True)  # -> RAS; plug-in component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
decomposepardict_scotch_2 = Butterfly_decomposeParDictScotch(num_of_cpus="10")  # -> decompose_par_dict; plug-in component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
solutionparams = Butterfly_SolutionParameters(control_dict=controldict, probes=probes)  # -> solution_par; plug-in component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
steadyincomp = Butterfly_SteadyIncompressibleRecipe(turbulence_prop=ras)  # -> report, recipe; plug-in component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
loadmesh = Butterfly_LoadMesh(case=snappyhexmesh.case, inner_mesh=False, load=Toggle(False))  # -> mesh; plug-in component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
solution = Butterfly_Solution(
    case=snappyhexmesh.case,
    recipe=steadyincomp.recipe,
    decompose_par_dict=decomposepardict_scotch,
    solution_par=solutionparams,
    interval=2,
    write=Toggle(True),
    run=Toggle(False))  # -> report, solution, is_running, timestep, residual_fields, residual_values, log_files; plug-in component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
pln = Plane(PlaneXY(891.0334579, 135.7128967, 0))
loadprobesvalue = Butterfly_LoadProbesValue(solution=solution.solution, field="U")  # -> values; plug-in component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
legendpar = LBLegendParameters(min=0, max=20, seg_count=9, continuous_leg=Toggle(False), num_decimals=0, base_plane=pln)  # -> leg_par; plug-in component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
panel_9 = Panel(solution.report)
Z = UnitZ(Factor="0.2")
move = Move(Geometry=point, Motion=Z)  # -> Geometry, Transform
data_2 = Data([0.4276065513, 1.01991773, 4.779875321, 0.4601235168, 4.101151309, 0.5183427065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])
data_3 = Data([0.7005364555, 0.5250661289, 1.113040006, 0.6124303051, 1.06604662, 0.4666735432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])
data_4 = Data([6.528888044, 6.84199924, 6.777646344, 5.821216763, 5.993827927, 5.420266294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])
data_5 = Data([0.6895540992, 0.2008666413, 0.4942700657, 0.1820683742, 0.5117167197, 0.1287312514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])
data_6 = Data([0.7005364555, 0.5250661289, 1.113040006, 0.6124303051, 1.06604662, 0.4666735432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])
data_7 = Data([0.6895540992, 0.2008666413, 0.4942700657, 0.1820683742, 0.5117167197, 0.1287312514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])
# W
data_8 = Data([Vector(-0.019268232, -0.10773151, -0.41336427), Vector(0.026583752, 0.90326871, 0.47289652), Vector(-0.032683178, 4.6479698, 1.1146823), Vector(0.036394781, 0.43312134, 0.15098005), Vector(0.42374042, 3.9321617, 1.0853527), Vector(0.1939531, 0.46710306, 0.11347285)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])
# SE
data_9 = Data([Vector(-1.5227431, 1.0382462, -0.65415667), Vector(-2.2981466, 0.071740845, -1.2489032), Vector(-3.3690883, -0.5363491, -1.9575703), Vector(-3.3185303, 0.98582612, -0.96606347), Vector(-4.2980346, 0.0096537457, -1.6422133), Vector(-3.9566302, 1.6865978, -0.90355699)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])
# S
data_10 = Data([Vector(-0.63725534, 0.020351314, -0.29024607), Vector(-0.40862892, -0.081706199, 0.31943848), Vector(0.19161435, -0.74202003, 0.8071854), Vector(-0.52869505, -0.24963322, 0.18230655), Vector(-0.052646318, -0.88452583, 0.59270382), Vector(-0.44911554, -0.12546703, -0.018369868)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])
# NW
data_11 = Data([Vector(0.53247466, -0.42496932, -0.10674178), Vector(0.10370287, -0.14270047, 0.096040534), Vector(-0.42112629, -0.078104511, 0.24677947), Vector(0.12816351, -0.095880782, 0.08669954), Vector(-0.43696255, 0.027076036, 0.2650366), Vector(-0.062149534, -0.022937428, 0.11041679)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])
# E
data_12 = Data([Vector(-0.25123946, 1.7461261, 0.079775299), Vector(-0.72588823, 2.6586677, -0.12035311), Vector(-0.08731436, 3.7346602, -0.22317036), Vector(-0.73925438, 2.0634945, -0.094942058), Vector(-0.08731436, 3.7346602, -0.22317036), Vector(-0.73882691, 1.5522183, -0.07216006)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])
# N
data_13 = Data([Vector(-4.847243, -0.14512627, -0.90195455), Vector(-4.5540767, 1.0645754, -1.2108376), Vector(-4.4660039, 2.2240009, -1.6393364), Vector(-3.437053, 1.1112651, -0.88795689), Vector(-3.3638803, 2.2552966, -1.5321), Vector(-2.402853, 0.90408463, -0.85394495)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])
data_14 = Data([1.766365754, 2.504164486, 3.853180417, 3.435779861, 4.50823263, 4.202540456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])
data_15 = Data([0.7925403956, 0.5572644278, 1.067057875, 0.6678860173, 1.012033475, 0.561714164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])
data_16 = Data([1.766365754, 2.504164486, 3.853180417, 3.435779861, 4.50823263, 4.202540456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])
data_17 = Data([1.60897372, 1.825597504, 4.575477287, 1.711630723, 4.006375769, 0.9663755817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])
data_18 = Data([4.928176351, 4.816639851, 5.209147837, 3.728734529, 4.297024417, 2.727552829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])
data_19 = Data([2.297502057, 2.944139406, 3.751974223, 2.614657245, 3.532187618, 2.341885167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])
heatmap = LBSpatialHeatmap(values=data_19, mesh=mesh_join, legend_par=legendpar)  # -> mesh, legend, title, colors, legend_par, vis_set; plug-in component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
data_20 = Data(heatmap.mesh)
round_to_decimal_place = RoundToDecimalPlace(NumberX=data_19, DecimalPlace=1, RoundType=0)  # -> Rounded, Difference
bnd = Bounds(Numbers=data_19)
dedomain = DeconstructDomain(Domain=bnd)  # -> Start, End
python_3_script_2 = Python3Script(mesh=mesh_join, speed=round_to_decimal_place.Rounded)  # -> out, mesh; inputs mesh: Mesh, speed: list of Double
# ---------- python_3_script_2: Python ----------
"""
Lawson 2001 Pedestrian Wind Comfort - Mesh Colouring
GHPython component

INPUTS:
    mesh   (Mesh)  : the analysis mesh
    speed  (list)  : local mean wind speed (m/s), one value per mesh
                     FACE or per mesh VERTEX (order matching the mesh).

OUTPUT:
    mesh   (Mesh)  : the same mesh, coloured by Lawson 2001 category
"""

import System.Drawing as sd

# ---------------------------------------------------------------
# Lawson 2001 comfort categories (5% exceedance thresholds, m/s)
#   A <= 4    Sitting        blue
#   B <= 6    Standing       light blue
#   C <= 8    Walking        green
#   D <= 10   Walking fast   amber
#   E >  10   Uncomfortable  red
# ---------------------------------------------------------------
BANDS = [
    (4.0,  sd.Color.FromArgb(  0, 112, 192)),
    (6.0,  sd.Color.FromArgb(  0, 176, 240)),
    (8.0,  sd.Color.FromArgb(  0, 176,  80)),
    (10.0, sd.Color.FromArgb(255, 192,   0)),
]
COLOR_E = sd.Color.FromArgb(255, 0, 0)


def color_for(v):
    for upper, col in BANDS:
        if v <= upper:
            return col
    return COLOR_E


m = mesh.DuplicateMesh()
n_verts = m.Vertices.Count
n_faces = m.Faces.Count
n = len(speed)

m.VertexColors.Clear()

if n == n_verts:
    # one value per vertex -> colour vertices directly
    for i in range(n_verts):
        m.VertexColors.Add(color_for(float(speed[i])))

elif n == n_faces:
    # one value per face -> push face colour onto its vertices
    vcol = [sd.Color.Gray] * n_verts
    for fi in range(n_faces):
        col = color_for(float(speed[fi]))
        f = m.Faces[fi]
        vids = [f.A, f.B, f.C] + ([f.D] if f.IsQuad else [])
        for vi in vids:
            vcol[vi] = col
    for c in vcol:
        m.VertexColors.Add(c)

else:
    raise Exception(
        "speed length ({0}) must equal vertex count ({1}) or face count ({2})."
        .format(n, n_verts, n_faces))

mesh = m
# ---------- end python_3_script_2 ----------
text_entity = TextEntity(Plane=point, Text=round_to_decimal_place.Rounded)  # -> TextEntity, Plane, Text, Style
gradient = Gradient(LowerLimit=dedomain.Start, UpperLimit=dedomain.End, Parameter=data_19, stops=[0: RGB(0, 0, 255), 0.719: RGB(255, 0, 0)])
bake = BakeObjects(Geometry=[python_3_script_2.mesh, heatmap.mesh], Bake=False, createGroups=False)  # -> Message, Ghosts
data_21 = Data(text_entity.TextEntity)
multiplication = Multiplication(A=data_19, B=0.1)
# Tree
# S
data_22 = Data([Vector(-0.74608994, 0.0084167241, -0.26720636), Vector(-0.45735683, -0.078665506, 0.30851274), Vector(0.21071892, -0.69037446, 0.78587095), Vector(-0.59484219, -0.25041536, 0.1718332), Vector(-0.06624579, -0.83890418, 0.56219483), Vector(-0.5471102, -0.1262174, -0.016198735)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])
# SE
data_23 = Data([Vector(-1.3810654, 0.92137995, -0.60312961), Vector(-2.1683809, -0.015094266, -1.252492), Vector(-3.2956133, -0.65360555, -1.8864602), Vector(-3.1738303, 0.90153885, -0.95844258), Vector(-4.1951911, -0.12614007, -1.6457891), Vector(-3.7876778, 1.5907142, -0.88570396)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])
# NW
data_24 = Data([Vector(-4.8771074, 4.2727827, -0.76389168), Vector(-4.6785671, 4.9331152, -0.76703189), Vector(-4.3590493, 5.1493036, -0.64795957), Vector(-3.7775335, 4.3712999, -0.71312162), Vector(-3.5764837, 4.7698111, -0.6193865), Vector(-3.3001709, 4.2544996, -0.62240813)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])
# W
data_25 = Data([Vector(-1.514919, 0.034963419, -0.54091997), Vector(1.6926241, -0.44827807, 0.51660108), Vector(4.4588139, -0.86021345, 0.56036045), Vector(1.5001637, -0.78155996, 0.26144337), Vector(3.84445, -1.0470435, 0.41827133), Vector(0.78800938, -0.51697386, 0.21368437)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])
# N
data_26 = Data([Vector(-4.8428068, -0.15129665, -0.90069627), Vector(-4.5561866, 1.0404751, -1.1655877), Vector(-4.4767858, 2.1628472, -1.5542529), Vector(-3.4613117, 1.085648, -0.86264183), Vector(-3.3990625, 2.1832505, -1.4643122), Vector(-2.4365156, 0.8906494, -0.84242496)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])
# E
data_27 = Data([Vector(-2.2651793, -0.3536463, 0.14970883), Vector(-2.8418426, -0.73639298, -0.22273944), Vector(-3.7070653, -0.41954015, -0.39870226), Vector(-2.4898764, -0.77695187, -0.18246592), Vector(-3.492591, -0.37002761, -0.37581517), Vector(-2.1659257, -0.87308266, -0.17583704)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])
panel_10 = Panel(data_27)
vlen = VectorLength(Vector=data_27)
larger = LargerThan(FirstNumber=vlen, SecondNumber=50)  # -> LargerThan, OrEqualTo
cull = CullPattern(List=vlen, CullPattern=invert(larger.LargerThan))
bnd_2 = Bounds(Numbers=cull)
dedomain_2 = DeconstructDomain(Domain=bnd_2)  # -> Start, End
py3 = Python3Script(x=vlen, y=dedomain_2.End)  # -> out, a; inputs x: list of Double, y: Double
# ---------- py3: Python ----------
a = [n if n <= y else y for n in x]
# ---------- end py3 ----------
amp = Amplitude(Vector=unitize(data_27), Amplitude="1.5")
line_2 = LineSDL(Start=move.Geometry, Direction=amp, Length=multiplication)
vdisex = VectorDisplayEx(Point=move.Geometry, Vector=amp, Colour=gradient, Width=2)
boolean_toggle = BooleanToggle(True)
panel_11 = Panel("""0
23""")
python_3_script_3 = Python3Script(
    U_N=data_13,
    U_E=data_12,
    U_SE=data_9,
    U_S=data_10,
    U_W=data_8,
    U_NW=data_11,
    epw=downloadepw.epw_file,
    hours=panel_11,
    run=boolean_toggle)  # -> category, label, u95, safety_pct, safety_fail, colors, report; inputs U_N: list, U_E: list, U_SE: list, U_S: list, U_W: list, U_NW: list, dirs: list, hours: list
# ---------- python_3_script_3: Python ----------
"""Lawson 2019 wind comfort from Butterfly runs, 6 directions (self-configuring, Rhino 8 Python 3).

Direction convention (same as EPW, meteorological)
  Run names and 'dirs' are the direction the wind comes FROM.
  Butterfly wind vector points where the air travels TO (opposite direction).
  Rhino +Y = North, +X = East.

    Input   From (deg)   Flow        Butterfly vector
    U_N       0          N to S      ( 0.000, -1.000, 0)
    U_E      90          E to W      (-1.000,  0.000, 0)
    U_SE    135          SE to NW    (-0.707,  0.707, 0)
    U_S     180          S to N      ( 0.000,  1.000, 0)
    U_W     270          W to E      ( 1.000,  0.000, 0)
    U_NW    315          NW to SE    ( 0.707, -0.707, 0)   Shamal

  EPW hours are assigned to the run with the nearest FROM direction.
"""
import math, bisect
import Grasshopper as gh
import System.Drawing as sd

L = gh.Kernel.GH_ParamAccess.list
I = gh.Kernel.GH_ParamAccess.item

# ---------------------------------------------------------------------------
# Component interface
# ---------------------------------------------------------------------------
INPUT_SPEC = [
    ("U_N",  "U vectors or speeds, wind FROM North (0 deg), flow N to S", L),
    ("U_E",  "U vectors or speeds, wind FROM East (90 deg), flow E to W", L),
    ("U_SE", "U vectors or speeds, wind FROM South-East (135 deg), flow SE to NW", L),
    ("U_S",  "U vectors or speeds, wind FROM South (180 deg), flow S to N", L),
    ("U_W",  "U vectors or speeds, wind FROM West (270 deg), flow W to E", L),
    ("U_NW", "U vectors or speeds, wind FROM North-West (315 deg), flow NW to SE", L),
    ("dirs", "Wind FROM direction (deg) per run, order N,E,SE,S,W,NW. Default 0,90,135,180,270,315", L),
    ("u_ref", "CFD reference speed at 10 m, default 10", I),
    ("epw", "Path to the Abu Dhabi EPW file", I),
    ("z0_met", "Roughness at weather station, default 0.03", I),
    ("z0_site", "Roughness used in CFD inlet, default 1.0", I),
    ("hours", "Optional [start, end] EPW hour filter (1-24), e.g. 7,19", L),
    ("run", "True to calculate", I),
]
OUTPUT_SPEC = [
    ("category", "0 A Frequent sitting, 1 B Occasional sitting, 2 C Standing, 3 D Walking, 4 E Uncomfortable"),
    ("label", "Lawson category name"),
    ("u95", "Speed exceeded 5% of hours (m/s)"),
    ("safety_pct", "% of hours above safety threshold"),
    ("safety_fail", "True if above safety exceedance limit"),
    ("colors", "Category colours for preview"),
    ("report", "Direction mapping, EPW check, category counts and settings"),
]

NAMES = ["U_N", "U_E", "U_SE", "U_S", "U_W", "U_NW"]
DEF_DIRS = [0.0, 90.0, 135.0, 180.0, 270.0, 315.0]

# ---------------------------------------------------------------------------
# Lawson 2019 (City of London) comfort categories (5% exceedance, m/s)
# ---------------------------------------------------------------------------
BANDS = [
    (2.5, "A Frequent sitting",   sd.Color.FromArgb(0, 112, 192)),
    (4.0, "B Occasional sitting", sd.Color.FromArgb(0, 176, 240)),
    (6.0, "C Standing",           sd.Color.FromArgb(0, 176, 80)),
    (8.0, "D Walking",            sd.Color.FromArgb(255, 192, 0)),
]
LABEL_E = "E Uncomfortable"
COLOR_E = sd.Color.FromArgb(255, 0, 0)

COMF_P = 5.0      # comfort exceedance (%)
SAFE_T = 15.0     # safety threshold (m/s), Lawson 2019 sensitive users
SAFE_P = 0.022    # safety exceedance (%), about 2 hours per year
ZB = 60.0         # blending height for terrain correction (m)

# ---------------------------------------------------------------------------
# Self-configuration
# ---------------------------------------------------------------------------
def _make(name, desc, access):
    try:
        from RhinoCodePluginGH.Parameters import ScriptVariableParam
        p = ScriptVariableParam(name)
    except Exception:
        p = gh.Kernel.Parameters.Param_GenericObject()
    p.Name = p.NickName = name
    p.Description = desc
    p.Access = access
    p.Optional = True
    return p

def _setup():
    c = ghenv.Component
    if [p.NickName for p in c.Params.Input] == [s[0] for s in INPUT_SPEC] and \
       [p.NickName for p in c.Params.Output] == [s[0] for s in OUTPUT_SPEC]:
        return False
    def _do(doc):
        for p in list(c.Params.Input): c.Params.UnregisterInputParameter(p)
        for p in list(c.Params.Output): c.Params.UnregisterOutputParameter(p)
        for n, d, a in INPUT_SPEC: c.Params.RegisterInputParam(_make(n, d, a))
        for n, d in OUTPUT_SPEC: c.Params.RegisterOutputParam(_make(n, d, I))
        try: c.VariableParameterMaintenance()
        except Exception: pass
        c.Params.OnParametersChanged()
        c.ExpireSolution(False)
    c.OnPingDocument().ScheduleSolution(5, gh.Kernel.GH_Document.GH_ScheduleDelegate(_do))
    return True

# ---------------------------------------------------------------------------
# Helpers
# ---------------------------------------------------------------------------
def _g(n, d=None):
    v = globals().get(n)
    if v is None or (isinstance(v, (list, tuple)) and len(v) == 0):
        return d
    return v

def _ratios(data, uref):
    return [(v.Length if hasattr(v, "Length") else float(v)) / uref for v in data]

def _angd(a, b):
    d = abs(a - b) % 360.0
    return min(d, 360.0 - d)

def _compass(a):
    pts = ["N", "NNE", "NE", "ENE", "E", "ESE", "SE", "SSE",
           "S", "SSW", "SW", "WSW", "W", "WNW", "NW", "NNW"]
    return pts[int((a % 360.0) / 22.5 + 0.5) % 16]

def _bf_vector(frm):
    """Butterfly wind vector (flow TO) for a FROM direction. +Y North, +X East."""
    t = math.radians((frm + 180.0) % 360.0)
    x, y = math.sin(t), math.cos(t)
    x = 0.0 if abs(x) < 1e-9 else x
    y = 0.0 if abs(y) < 1e-9 else y
    return "(%.3f, %.3f, 0)" % (x, y)

def _read_epw(path, hrs):
    ws, wd = [], []
    with open(path, encoding="utf-8", errors="ignore") as f:
        lines = f.readlines()[8:]
    for ln in lines:
        c = ln.split(",")
        if len(c) < 22:
            continue
        h, d, s = int(c[3]), float(c[20]), float(c[21])   # EPW: [20] dir FROM, [21] speed
        if s >= 999 or d >= 999:
            continue
        if hrs and not (hrs[0] <= h <= hrs[1]):
            continue
        ws.append(s); wd.append(d % 360.0)
    return ws, wd

def _sector_bounds(frm):
    n = len(frm)
    order = sorted(range(n), key=lambda j: frm[j])
    b = {}
    for idx, j in enumerate(order):
        if n == 1:
            b[j] = (0.0, 360.0); continue
        p = frm[order[idx - 1]]
        q = frm[order[(idx + 1) % n]]
        gp = (frm[j] - p) % 360.0
        gq = (q - frm[j]) % 360.0
        b[j] = ((frm[j] - gp / 2.0) % 360.0, (frm[j] + gq / 2.0) % 360.0)
    return b

def _classify(u):
    for i, (t, name, col) in enumerate(BANDS):
        if u <= t:
            return i, name, col
    return len(BANDS), LABEL_E, COLOR_E

# ---------------------------------------------------------------------------
# Main
# ---------------------------------------------------------------------------
def main():
    err = lambda m: [None] * 6 + [m]
    runs = [_g(n) for n in NAMES]
    dirs_in = [float(x) for x in _g("dirs", DEF_DIRS)]
    if len(dirs_in) != len(NAMES):
        return err("dirs needs 6 values in order N, E, SE, S, W, NW.")
    uref = float(_g("u_ref", 10.0))
    if uref <= 0:
        return err("u_ref must be > 0.")
    z0m, z0s = float(_g("z0_met", 0.03)), float(_g("z0_site", 1.0))
    hrs = [int(x) for x in _g("hours", [])] or None

    vr, frm, used = [], [], []
    for n, r, d in zip(NAMES, runs, dirs_in):
        if r:
            vr.append(_ratios(r, uref)); frm.append(d % 360.0); used.append(n)
    if not vr:
        return err("Connect at least one run.")
    if len(set(round(f, 3) for f in frm)) != len(frm):
        return err("Duplicate directions in dirs.")
    npts = len(vr[0])
    if any(len(v) != npts for v in vr):
        return err("Point counts differ between runs: " +
                   ", ".join("%s=%d" % (n, len(v)) for n, v in zip(used, vr)))

    tf = (math.log(ZB / z0m) / math.log(10.0 / z0m)) * \
         (math.log(10.0 / z0s) / math.log(ZB / z0s))
    ws, wd = _read_epw(_g("epw"), hrs)
    N = float(len(ws))
    if N == 0:
        return err("No valid EPW hours read.")

    # Assign each EPW hour (FROM) to the run with the nearest FROM direction
    nd = len(frm)
    secs = [[] for _ in range(nd)]
    hrs_sec, cov, sum_s = [0] * nd, [0] * nd, [0.0] * nd
    calm, flip = 0, 0
    rose = [0] * 8
    for s, d in zip(ws, wd):
        if s <= 0.0:
            calm += 1          # calm: counts in N, never exceeds
            continue
        rose[int((d + 22.5) % 360.0 // 45.0)] += 1
        dist = [_angd(d, f) for f in frm]
        m = min(dist)
        ks = [j for j, x in enumerate(dist) if abs(x - m) < 1e-9]
        k = ks[flip % len(ks)] if len(ks) > 1 else ks[0]
        if len(ks) > 1:
            flip += 1
        secs[k].append(s * tf); hrs_sec[k] += 1; sum_s[k] += s
        if m <= 22.5:
            cov[k] += 1
    for l in secs:
        l.sort()

    def exc(i, T):
        c = 0
        for k, l in enumerate(secs):
            r = vr[k][i]
            if r > 1e-6:
                c += len(l) - bisect.bisect_right(l, T / r)
        return 100.0 * c / N

    cat, lab, u95, sp, sf, col = [], [], [], [], [], []
    for i in range(npts):
        lo, hi = 0.0, 40.0
        for _ in range(40):
            m = 0.5 * (lo + hi)
            if exc(i, m) > COMF_P: lo = m
            else: hi = m
        c, name, colr = _classify(hi)
        p = exc(i, SAFE_T)
        cat.append(c); lab.append(name); u95.append(round(hi, 2))
        sp.append(round(p, 4)); sf.append(p > SAFE_P); col.append(colr)

    # ---------------- Report ----------------
    bnd = _sector_bounds(frm)
    nc = max(N - calm, 1.0)
    map_lines = []
    for k, n in enumerate(used):
        map_lines.append(
            "  %-5s from %-3s (%5.1f) | Butterfly vector %s | sector %5.1f-%5.1f | "
            "hours %5.1f%% | within +/-22.5: %5.1f%% | mean EPW %.1f m/s" % (
                n, _compass(frm[k]), frm[k], _bf_vector(frm[k]),
                bnd[k][0], bnd[k][1], 100.0 * hrs_sec[k] / nc, 100.0 * cov[k] / nc,
                (sum_s[k] / hrs_sec[k]) if hrs_sec[k] else 0.0))

    rose_names = ["N", "NE", "E", "SE", "S", "SW", "W", "NW"]
    rose_lines = []
    for j, rn in enumerate(rose_names):
        ctr = j * 45.0
        has = min(_angd(ctr, f) for f in frm) <= 22.5
        rose_lines.append("  from %-2s %5.1f%%%s" % (
            rn, 100.0 * rose[j] / nc, "" if has else "   (no run, absorbed by nearest)"))

    all_names = [b[1] for b in BANDS] + [LABEL_E]
    counts = "\n".join("  %s: %d" % (n, cat.count(i)) for i, n in enumerate(all_names))
    rep = ("Criteria: Lawson 2019 (City of London)\n"
           "Direction convention: wind FROM (EPW meteorological)\n"
           "Hours used: %d (calm %d)\n"
           "Terrain factor (site/EPW): %.3f\n"
           "Run to EPW mapping (%% of non-calm hours):\n%s\n"
           "EPW wind rose, FROM direction (%% of non-calm hours):\n%s\n"
           "Total coverage within +/-22.5 deg: %.1f%%\n"
           "Category counts:\n%s\n"
           "Points failing safety (>%.0f m/s for >%.3f%%): %d of %d") % (
           int(N), calm, tf, "\n".join(map_lines), "\n".join(rose_lines),
           100.0 * sum(cov) / nc, counts, SAFE_T, SAFE_P, sum(sf), npts)
    return cat, lab, u95, sp, sf, col, rep

if not _setup() and _g("run", False) and _g("epw"):
    category, label, u95, safety_pct, safety_fail, colors, report = main()
# ---------- end python_3_script_3 ----------
python_3_script_4 = Python3Script(
    U_N=data_27,
    U_NW=data_27,
    U_W=data_27,
    U_S=data_27,
    U_E=data_27,
    epw=downloadepw.epw_file,
    hours=panel_11,
    run=boolean_toggle)  # -> category, label, u95, safety_pct, safety_fail, colors, report; inputs U_N: list, U_NW: list, U_W: list, U_S: list, U_E: list, dirs: list, hours: list
# ---------- python_3_script_4: Python ----------
"""Lawson 2019 wind comfort from Butterfly runs, 5 directions (self-configuring, Rhino 8 Python 3)."""
import math, bisect
import Grasshopper as gh
import System.Drawing as sd

L = gh.Kernel.GH_ParamAccess.list
I = gh.Kernel.GH_ParamAccess.item

# ---------------------------------------------------------------------------
# Component interface
# ---------------------------------------------------------------------------
INPUT_SPEC = [
    ("U_N",  "U vectors or speeds, run FROM North (fixed point order)", L),
    ("U_NW", "U vectors or speeds, run FROM North-West", L),
    ("U_W",  "U vectors or speeds, run FROM West", L),
    ("U_S",  "U vectors or speeds, run FROM South", L),
    ("U_E",  "U vectors or speeds, run FROM East", L),
    ("dirs", "FROM-direction (deg) of each run, default 0,315,270,180,90", L),
    ("u_ref", "CFD reference speed at 10 m, default 10", I),
    ("epw", "Path to the Abu Dhabi EPW file", I),
    ("z0_met", "Roughness at weather station, default 0.03", I),
    ("z0_site", "Roughness used in CFD inlet, default 1.0", I),
    ("hours", "Optional [start, end] hour filter, e.g. 7,19", L),
    ("run", "True to calculate", I),
]
OUTPUT_SPEC = [
    ("category", "0 A Frequent sitting, 1 B Occasional sitting, 2 C Standing, 3 D Walking, 4 E Uncomfortable"),
    ("label", "Lawson category name"),
    ("u95", "Speed exceeded 5% of hours (m/s)"),
    ("safety_pct", "% of hours above safety threshold"),
    ("safety_fail", "True if above safety exceedance limit"),
    ("colors", "Category colours for preview"),
    ("report", "Coverage, category counts and settings summary"),
]

# ---------------------------------------------------------------------------
# Lawson 2019 (City of London) comfort categories (5% exceedance, m/s)
#   A <= 2.5  Frequent sitting     blue
#   B <= 4    Occasional sitting   light blue
#   C <= 6    Standing             green
#   D <= 8    Walking              amber
#   E >  8    Uncomfortable        red
# ---------------------------------------------------------------------------
BANDS = [
    (2.5, "A Frequent sitting",   sd.Color.FromArgb(0, 112, 192)),
    (4.0, "B Occasional sitting", sd.Color.FromArgb(0, 176, 240)),
    (6.0, "C Standing",           sd.Color.FromArgb(0, 176, 80)),
    (8.0, "D Walking",            sd.Color.FromArgb(255, 192, 0)),
]
LABEL_E = "E Uncomfortable"
COLOR_E = sd.Color.FromArgb(255, 0, 0)

COMF_P = 5.0      # comfort exceedance (%)
SAFE_T = 15.0     # safety threshold (m/s), Lawson 2019 sensitive users
SAFE_P = 0.022    # safety exceedance (%), about 2 hours per year
ZB = 60.0         # blending height for terrain correction (m)

# ---------------------------------------------------------------------------
# Self-configuration
# ---------------------------------------------------------------------------
def _make(name, desc, access):
    try:
        from RhinoCodePluginGH.Parameters import ScriptVariableParam
        p = ScriptVariableParam(name)
    except Exception:
        p = gh.Kernel.Parameters.Param_GenericObject()
    p.Name = p.NickName = name
    p.Description = desc
    p.Access = access
    p.Optional = True
    return p

def _setup():
    c = ghenv.Component
    if [p.NickName for p in c.Params.Input] == [s[0] for s in INPUT_SPEC] and \
       [p.NickName for p in c.Params.Output] == [s[0] for s in OUTPUT_SPEC]:
        return False
    def _do(doc):
        for p in list(c.Params.Input): c.Params.UnregisterInputParameter(p)
        for p in list(c.Params.Output): c.Params.UnregisterOutputParameter(p)
        for n, d, a in INPUT_SPEC: c.Params.RegisterInputParam(_make(n, d, a))
        for n, d in OUTPUT_SPEC: c.Params.RegisterOutputParam(_make(n, d, I))
        try: c.VariableParameterMaintenance()
        except Exception: pass
        c.Params.OnParametersChanged()
        c.ExpireSolution(False)
    c.OnPingDocument().ScheduleSolution(5, gh.Kernel.GH_Document.GH_ScheduleDelegate(_do))
    return True

# ---------------------------------------------------------------------------
# Helpers
# ---------------------------------------------------------------------------
def _g(n, d=None):
    v = globals().get(n)
    if v is None or (isinstance(v, (list, tuple)) and len(v) == 0):
        return d
    return v

def _ratios(data, uref):
    return [(v.Length if hasattr(v, "Length") else float(v)) / uref for v in data]

def _angd(a, b):
    d = abs(a - b) % 360.0
    return min(d, 360.0 - d)

def _read_epw(path, hrs):
    ws, wd = [], []
    with open(path, encoding="utf-8", errors="ignore") as f:
        lines = f.readlines()[8:]
    for ln in lines:
        c = ln.split(",")
        if len(c) < 22:
            continue
        h, d, s = int(c[3]), float(c[20]), float(c[21])
        if s >= 999 or d >= 999:
            continue
        if hrs and not (hrs[0] <= h <= hrs[1]):
            continue
        ws.append(s); wd.append(d)
    return ws, wd

def _classify(u):
    for i, (t, name, col) in enumerate(BANDS):
        if u <= t:
            return i, name, col
    return len(BANDS), LABEL_E, COLOR_E

# ---------------------------------------------------------------------------
# Main
# ---------------------------------------------------------------------------
def main():
    names = ["U_N", "U_NW", "U_W", "U_S", "U_E"]
    runs = [_g(n) for n in names]
    dirs_in = [float(x) for x in _g("dirs", [0, 315, 270, 180, 90])]
    if len(dirs_in) < len(runs):
        return [None] * 6 + ["dirs needs 5 values (N, NW, W, S, E order)."]
    uref = float(_g("u_ref", 10.0))
    z0m, z0s = float(_g("z0_met", 0.03)), float(_g("z0_site", 1.0))
    hrs = [int(x) for x in _g("hours", [])] or None

    vr, dirs, used = [], [], []
    for n, r, d in zip(names, runs, dirs_in):
        if r:
            vr.append(_ratios(r, uref)); dirs.append(d); used.append(n)
    if not vr:
        return [None] * 6 + ["Connect at least one run."]
    npts = len(vr[0])
    if any(len(v) != npts for v in vr):
        return [None] * 6 + ["Point counts differ between runs: " +
                             ", ".join("%s=%d" % (n, len(v)) for n, v in zip(used, vr))]

    tf = (math.log(ZB / z0m) / math.log(10.0 / z0m)) * \
         (math.log(10.0 / z0s) / math.log(ZB / z0s))
    ws, wd = _read_epw(_g("epw"), hrs)
    N = float(len(ws))
    if N == 0:
        return [None] * 6 + ["No valid EPW hours read."]

    secs = [[] for _ in dirs]
    cov_sec = [0] * len(dirs)
    for s, d in zip(ws, wd):
        k = min(range(len(dirs)), key=lambda j: _angd(d, dirs[j]))
        if _angd(d, dirs[k]) <= 22.5:
            cov_sec[k] += 1
        secs[k].append(s * tf)
    for l in secs:
        l.sort()

    def exc(i, T):
        c = 0
        for k, l in enumerate(secs):
            r = vr[k][i]
            if r > 1e-6:
                c += len(l) - bisect.bisect_right(l, T / r)
        return 100.0 * c / N

    cat, lab, u95, sp, sf, col = [], [], [], [], [], []
    for i in range(npts):
        lo, hi = 0.0, 40.0
        for _ in range(40):
            m = 0.5 * (lo + hi)
            if exc(i, m) > COMF_P: lo = m
            else: hi = m
        c, name, colr = _classify(hi)
        p = exc(i, SAFE_T)
        cat.append(c); lab.append(name); u95.append(round(hi, 2))
        sp.append(round(p, 4)); sf.append(p > SAFE_P); col.append(colr)

    all_names = [b[1] for b in BANDS] + [LABEL_E]
    counts = "\n".join("  %s: %d" % (n, cat.count(i)) for i, n in enumerate(all_names))
    per_dir = ", ".join("%s %.1f%%" % (n, 100.0 * c / N) for n, c in zip(used, cov_sec))
    rep = ("Criteria: Lawson 2019 (City of London)\nRuns used: %s\nHours used: %d\nTerrain factor (site/EPW): %.3f\n"
           "Coverage within +/-22.5 deg: %.1f%% (%s)\n"
           "Category counts:\n%s\n"
           "Points failing safety (>%.0f m/s for >%.3f%%): %d of %d") % (
           ", ".join(used), N, tf, 100.0 * sum(cov_sec) / N, per_dir,
           counts, SAFE_T, SAFE_P, sum(sf), npts)
    return cat, lab, u95, sp, sf, col, rep

if not _setup() and _g("run", False) and _g("epw"):
    category, label, u95, safety_pct, safety_fail, colors, report = main()
# ---------- end python_3_script_4 ----------
python_3_script_5 = Python3Script(U_N=data_27, U_NW=data_27, U_W=data_27, U_S=data_27, epw=downloadepw.epw_file, hours=panel_11, run=boolean_toggle)  # -> category, label, u95, safety_pct, safety_fail, colors, report; inputs U_N: list, U_NW: list, U_W: list, U_S: list, dirs: list, hours: list
# ---------- python_3_script_5: Python ----------
"""Lawson wind comfort from Butterfly runs (self-configuring, Rhino 8)."""
import math, bisect
import Grasshopper as gh
import System.Drawing as sd

L = gh.Kernel.GH_ParamAccess.list
I = gh.Kernel.GH_ParamAccess.item
INPUT_SPEC = [
    ("U_N",  "U vectors or speeds, run FROM North (point order fixed)", L),
    ("U_NW", "U vectors or speeds, run FROM North-West", L),
    ("U_W",  "U vectors or speeds, run FROM West", L),
    ("U_S",  "U vectors or speeds, run FROM South", L),
    ("dirs", "FROM-direction (deg) of each run, default 0,315,270,180", L),
    ("u_ref", "CFD reference speed at 10 m, default 10", I),
    ("epw", "Path to the Abu Dhabi EPW file", I),
    ("z0_met", "Roughness at weather station, default 0.03", I),
    ("z0_site", "Roughness used in CFD inlet, default 1.0", I),
    ("hours", "Optional [start, end] hour filter, e.g. 7,19 for daytime use", L),
    ("run", "True to calculate", I),
]
OUTPUT_SPEC = [
    ("category", "0 Freq sitting, 1 Occ sitting, 2 Standing, 3 Walking, 4 Uncomfortable"),
    ("label", "Lawson category name"),
    ("u95", "Speed exceeded 5% of hours (m/s)"),
    ("safety_pct", "% of hours above 15 m/s"),
    ("safety_fail", "True if above 0.022%"),
    ("colors", "Category colours for preview"),
    ("report", "Coverage and settings summary"),
]

def _make(name, desc, access):
    try:
        from RhinoCodePluginGH.Parameters import ScriptVariableParam
        p = ScriptVariableParam(name)
    except Exception:
        p = gh.Kernel.Parameters.Param_GenericObject()
    p.Name = p.NickName = name
    p.Description = desc
    p.Access = access
    p.Optional = True
    return p

def _setup():
    c = ghenv.Component
    if [p.NickName for p in c.Params.Input] == [s[0] for s in INPUT_SPEC] and \
       [p.NickName for p in c.Params.Output] == [s[0] for s in OUTPUT_SPEC]:
        return False
    def _do(doc):
        for p in list(c.Params.Input): c.Params.UnregisterInputParameter(p)
        for p in list(c.Params.Output): c.Params.UnregisterOutputParameter(p)
        for n, d, a in INPUT_SPEC: c.Params.RegisterInputParam(_make(n, d, a))
        for n, d in OUTPUT_SPEC: c.Params.RegisterOutputParam(_make(n, d, I))
        try: c.VariableParameterMaintenance()
        except Exception: pass
        c.Params.OnParametersChanged()
        c.ExpireSolution(False)
    c.OnPingDocument().ScheduleSolution(5, gh.Kernel.GH_Document.GH_ScheduleDelegate(_do))
    return True

THR = [2.5, 4.0, 6.0, 8.0]          # Lawson comfort limits, 5% exceedance
NAMES = ["Frequent sitting", "Occasional sitting", "Standing", "Walking", "Uncomfortable"]
COLS = [(46, 134, 193), (133, 193, 233), (171, 235, 198), (249, 231, 159), (231, 76, 60)]
SAFE_T, SAFE_P, COMF_P = 15.0, 0.022, 5.0

def _g(n, d=None):
    v = globals().get(n)
    if v is None or (isinstance(v, (list, tuple)) and len(v) == 0): return d
    return v

def _speeds(data, uref):
    out = []
    for v in data:
        s = v.Length if hasattr(v, "Length") else float(v)
        out.append(s / uref)
    return out

def _angd(a, b):
    d = abs(a - b) % 360.0
    return min(d, 360.0 - d)

def _read_epw(path, hrs):
    ws, wd = [], []
    with open(path) as f:
        lines = f.readlines()[8:]
    for ln in lines:
        c = ln.split(",")
        if len(c) < 22: continue
        h, d, s = int(c[3]), float(c[20]), float(c[21])
        if s >= 999 or d >= 999: continue
        if hrs and not (hrs[0] <= h <= hrs[1]): continue
        ws.append(s); wd.append(d)
    return ws, wd

def main():
    runs = [_g("U_N"), _g("U_NW"), _g("U_W"), _g("U_S")]
    dirs_in = [float(x) for x in _g("dirs", [0, 315, 270, 180])]
    uref = float(_g("u_ref", 10.0))
    z0m, z0s = float(_g("z0_met", 0.03)), float(_g("z0_site", 1.0))
    hrs = [int(x) for x in _g("hours", [])] or None
    vr, dirs = [], []
    for r, d in zip(runs, dirs_in):
        if r: vr.append(_speeds(r, uref)); dirs.append(d)
    if not vr: return [None] * 6 + ["Connect at least one run."]
    n = len(vr[0])
    if any(len(v) != n for v in vr): return [None] * 6 + ["Point counts differ between runs."]

    zb = 60.0  # blending height (m)
    tf = (math.log(zb / z0m) / math.log(10.0 / z0m)) * (math.log(10.0 / z0s) / math.log(zb / z0s))
    ws, wd = _read_epw(_g("epw"), hrs)
    N = float(len(ws))

    secs = [[] for _ in dirs]; cov = 0
    for s, d in zip(ws, wd):
        k = min(range(len(dirs)), key=lambda j: _angd(d, dirs[j]))
        if _angd(d, dirs[k]) <= 22.5: cov += 1
        secs[k].append(s * tf)
    for l in secs: l.sort()

    def exc(i, T):
        c = 0
        for k, l in enumerate(secs):
            r = vr[k][i]
            if r > 1e-6: c += len(l) - bisect.bisect_right(l, T / r)
        return 100.0 * c / N

    cat, lab, u95, sp, sf, col = [], [], [], [], [], []
    for i in range(n):
        lo, hi = 0.0, 40.0
        for _ in range(40):
            m = 0.5 * (lo + hi)
            if exc(i, m) > COMF_P: lo = m
            else: hi = m
        c = len(THR)
        for j, t in enumerate(THR):
            if hi <= t: c = j; break
        p = exc(i, SAFE_T)
        cat.append(c); lab.append(NAMES[c]); u95.append(round(hi, 2))
        sp.append(round(p, 4)); sf.append(p > SAFE_P)
        col.append(sd.Color.FromArgb(*COLS[c]))

    rep = ("Hours used: %d\nTerrain factor (site/EPW): %.3f\n"
           "Hours within +/-22.5 deg of a simulated direction: %.1f%%\n"
           "Points failing safety: %d of %d") % (N, tf, 100.0 * cov / N, sum(sf), n)
    return cat, lab, u95, sp, sf, col, rep

if not _setup() and _g("run", False) and _g("epw"):
    category, label, u95, safety_pct, safety_fail, colors, report = main()
# ---------- end python_3_script_5 ----------
python_3_script_6 = Python3Script(
    U_N=data_26,
    U_E=data_27,
    U_SE=data_23,
    U_S=data_22,
    U_W=data_25,
    U_NW=data_24,
    epw=downloadepw.epw_file,
    hours=panel_11,
    run=boolean_toggle)  # -> category, label, u95, safety_pct, safety_fail, colors, report; inputs U_N: list, U_E: list, U_SE: list, U_S: list, U_W: list, U_NW: list, dirs: list, hours: list; same code as python_3_script_3
cull_vertices = CullVertices(Mesh=mesh_join, Pattern=python_3_script_5.safety_fail, Shrink=True)
dispatch = Dispatch(DispatchPattern=[True, False])  # -> ListA, ListB
python_3_script_7 = Python3Script(
    bools=python_3_script_6.safety_fail,
    true_val=ColourSwatch(SwatchColor=RGB(255, 0, 0)),
    false_val=ColourSwatch(SwatchColor=RGB(81, 255, 0)))  # -> result, true_idx, false_idx; inputs bools: list
# ---------- python_3_script_7: Python ----------
"""Map a bool list to two values: True -> true_val, False -> false_val (self-configuring, Rhino 8 Python 3)."""
import Grasshopper as gh

L = gh.Kernel.GH_ParamAccess.list
I = gh.Kernel.GH_ParamAccess.item

INPUT_SPEC = [
    ("bools", "List of booleans", L),
    ("true_val", "Item to use where bool is True", I),
    ("false_val", "Item to use where bool is False", I),
]
OUTPUT_SPEC = [
    ("result", "Mapped list, same order as bools"),
    ("true_idx", "Indices where bool is True"),
    ("false_idx", "Indices where bool is False"),
]

def _make(name, desc, access):
    try:
        from RhinoCodePluginGH.Parameters import ScriptVariableParam
        p = ScriptVariableParam(name)
    except Exception:
        p = gh.Kernel.Parameters.Param_GenericObject()
    p.Name = p.NickName = name
    p.Description = desc
    p.Access = access
    p.Optional = True
    return p

def _setup():
    c = ghenv.Component
    if [p.NickName for p in c.Params.Input] == [s[0] for s in INPUT_SPEC] and \
       [p.NickName for p in c.Params.Output] == [s[0] for s in OUTPUT_SPEC]:
        return False
    def _do(doc):
        for p in list(c.Params.Input): c.Params.UnregisterInputParameter(p)
        for p in list(c.Params.Output): c.Params.UnregisterOutputParameter(p)
        for n, d, a in INPUT_SPEC: c.Params.RegisterInputParam(_make(n, d, a))
        for n, d in OUTPUT_SPEC: c.Params.RegisterOutputParam(_make(n, d, L))
        try: c.VariableParameterMaintenance()
        except Exception: pass
        c.Params.OnParametersChanged()
        c.ExpireSolution(False)
    c.OnPingDocument().ScheduleSolution(5, gh.Kernel.GH_Document.GH_ScheduleDelegate(_do))
    return True

def _to_bool(v):
    if isinstance(v, str):
        return v.strip().lower() in ("true", "1", "yes")
    return bool(v)

if not _setup():
    data = globals().get("bools") or []
    tv = globals().get("true_val")
    fv = globals().get("false_val")
    flags = [_to_bool(b) for b in data]
    result = [tv if f else fv for f in flags]
    true_idx = [i for i, f in enumerate(flags) if f]
    false_idx = [i for i, f in enumerate(flags) if not f]
# ---------- end python_3_script_7 ----------
mesh_colours = MeshColours(Mesh=mesh_join, Colours=python_3_script_5.colors)
panel_12 = Panel(python_3_script_6.report)
custom_preview = CustomPreview(Geometry=brep_6, Material=python_3_script_3.colors)
custom_preview_2 = CustomPreview(Geometry=brep_6, Material=python_3_script_6.colors)
panel_13 = Panel(python_3_script_6.safety_fail)
custom_preview_3 = CustomPreview(Geometry=brep_6, Material=python_3_script_7.result)
